# Grasshopper definition 221007_unroll_panel.ghx (Grasshopper 1.0.7)
# plug-ins: Human, Wombat, Pufferfish

input = DataInput(
    Destination="/Volumes/GoogleDrive-110500231569640047002/Общие диски/CONTEXTMACHINE/PROJECTS/2202_Lahta_Arc/Lahta Arc_WORK/MP/gh_data/panel_test_2.ghdata",
    RelativePath="/Volumes/GoogleDrive-110500231569640047002/Общие диски/CONTEXTMACHINE/PROJECTS/2202_Lahta_Arc/Lahta Arc_WORK/MP/gh_data/panel_test_2.ghdata|../../../../../../Volumes/GoogleDrive-110500231569640047002/Общие диски/CONTEXTMACHINE/PROJECTS/2202_Lahta_Arc/Lahta Arc_WORK/MP/gh_data/panel_test_2.ghdata",
    UpdateDelay=50000)  # -> Hyp_panels_surf_3, Hyp_panels_surf_6
flip = FlipMatrix(Data=input.Hyp_panels_surf_6)
item = ListItem(List=flip, Index=Slider(2, range=0..10), Wrap=True)  # -> flatten(Item)
item_2 = ListItem(List=item, Index=0, Wrap=True)  # -> Item, Item1
flip_2 = Flip(Surface=item_2.Item)  # -> Surface, Result
flip_3 = Flip(Surface=item_2.Item1)  # -> Surface, Result
code = Code("""\"\"\"Provides a scripting component.
    Inputs:
        x: The x script variable
        y: The y script variable
    Output:
        a: The a output variable\"\"\"

__author__ = "sofyadobycina"

import rhinoscriptsyntax as rs
import Rhino.Geometry as rh
import math

class BendSide:
    side_offset = 0.5
    angle = 30
    length = 35
    
    @property
    def top_offset(self):
        self._top_offset = self.length / math.tan(math.radians(self.angle))
        return self._top_offset
        
    @property
    def top_part(self):
        return self._top_part
    
    @property
    def join(self):
        one = rh.Line(self.curve.PointAtStart, self.top_part.PointAtStart).ToNurbsCurve()
        two = rh.Line(self.curve.PointAtEnd, self.top_part.PointAtEnd).ToNurbsCurve()
        self._join = rh.Curve.JoinCurves([self.curve, one, self.top_part, two])
        return self._join[0]
    
    def __init__(self, curve):
        self.curve = self.curve_offset(curve)
        
    
    def curve_offset(self, curve):
        crv = rh.Curve.Offset(curve, rh.Plane.WorldXY, -self.side_offset, 0.01, rh.CurveOffsetCornerStyle.None)
        return crv[0]
        

class Niche(BendSide):
    side_offset = 0.5
    
    @property
    def top_part(self):
        p_one = rh.Curve.LengthParameter(self.curve, self.top_offset)
        p_two = rh.Curve.LengthParameter(self.curve, self.curve.GetLength()- self.top_offset)
        trimed = rh.Curve.Trim(self.curve, p_one[1], p_two[1])
        
        self._top_part = rh.Curve.Offset(trimed, rh.Plane.WorldXY, self.length, 0.01, rh.CurveOffsetCornerStyle.None)
        return self._top_part[0]
    
    def __init__(self, curve):
        BendSide.__init__(self, curve)
    
    

        
        
class Side(BendSide):
    side_offset = 1.0
    
    @property
    def top_part(self):
        if self.reverse is False: 
            p_one = rh.Curve.LengthParameter(self.curve, self.curve.GetLength() - self.top_offset)
            trimed = rh.Curve.Trim(self.curve, self.curve.Domain[0], p_one[1])
        else:
            p_one = rh.Curve.LengthParameter(self.curve, self.top_offset)
            trimed = rh.Curve.Trim(self.curve, p_one[1], self.curve.Domain[1])
        
        self._top_part = rh.Curve.Offset(trimed, rh.Plane.WorldXY, self.length, 0.01, rh.CurveOffsetCornerStyle.None)
        return self._top_part[0]
    
    def __init__(self, curve, reverse):
        BendSide.__init__(self, curve)
        self.reverse = reverse


class Schov(BendSide):
    side_offset = 1.25
    
    def __init__(self, curve):
        BendSide.__init__(self, curve)


class Panel:
    niche_offset = 0.5
    sides_offset = 1.0
    schov_offset = 1.25

    
    def __init__(self, surface, type):
        
        self.type = type
        
        self.surf = surface
        self.unrol_surf = rh.Unroller(self.surf).PerformUnroll()[0][0]
        self.edges = self.unrol_surf.Curves3D
        
        self.side_types()
        
    def side_types(self):
        
        if self.type == 0:
            self.niche = Niche(self.edges[0])
            self.schov = Schov(self.edges[2])
            self.side = [Side(self.edges[1], True), Side(self.edges[3], False)]
            
        else:
            self.niche = Niche(self.edges[2])
            self.schov = Schov(self.edges[0])
            self.side = [Side(self.edges[1], False), Side(self.edges[3], True)]
        
        self.side_types = [self.niche, self.schov, self.side[0], self.side[1]]
        self.intersect()

    def intersect(self):
        new_crv=[]
        for i, v in enumerate(self.side_types):
            param =[]
            for ind, val in enumerate(self.side_types):
                if i != ind:
                    inters = rs.CurveCurveIntersection(v.curve,val.curve)
                    if inters is not None:
                        param.append(inters[0][5])
            param = sorted(param)

            trimed = rh.Curve.Trim(v.curve, param[0], param[1])
            v.curve = trimed





b = Panel(surf_left, 1)
a = b.unrol_surf
edge = b.edges[3]
niche = b.niche.join
schov = b.schov.curve
top = b.side[0].join
bottom = b.side[1].join
print(b.side[0].join)""")
file = ReadFile(File="/Users/sofyadobycina/Documents/GitHub/mmodel/panels_gh/main.py", PerLineParse=False)
python = GhPythonScript(Code=file, Surf_right=flip_2.Surface, Surf_left=flip_3.Surface)  # -> Out, Niche, Schov, Bottom, Top
crv = Curve(python.Schov)
panel = Panel(python.Schov)
panel_2 = Panel(file)
pt = Point(Point(0.05, 0.95, 0))
pt_2 = Point("{0.05, 0.95, 0}")
pt_3 = Point("{0.95, 0.95, 0}")
pt_4 = Point("{0.95, 0.05, 0}")
merge = Merge(Data1=pt_4, Data2=pt_2, Data3=pt_3)
evalsrf = EvaluateSurface(Surface=reparameterize(flip_2.Surface), Point=merge)  # -> Point, Normal, UDirection, VDirection, Frame
unroll_brep = UnrollBrep(Brep=flip_2.Surface, Points=evalsrf.Point)  # -> flatten(Brep), Curves, Points
flip_4 = Flip(Surface=item_2.Item1)  # -> Surface, Result
item_3 = ListItem(List=evalsrf.Point, Index=0, Wrap=True)  # -> Item, Item1, Item2
wires = BrepWireframe(Brep=flip_2.Surface, Density=-1)
pt_5 = Point(item_3.Item)
item_4 = ListItem(List=unroll_brep.Points, Index=0, Wrap=True)  # -> Item, Item1, Item2
pt_6 = Point(Point(0.05, 0.95, 0))
pl_3pt = Plane3Pt(PointA=item_3.Item, PointB=item_3.Item1, PointC=item_3.Item2)
pl_3pt_2 = Plane3Pt(PointA=item_4.Item, PointB=item_4.Item1, PointC=item_4.Item2)
item_5 = ListItem(List=unroll_brep.Brep, Index=0, Wrap=True)
panel_3 = Panel(pt)
pt_7 = Point("{0.05, 0.95, 0}")
pt_8 = Point("{0.95, 0.95, 0}")
wires_2 = BrepWireframe(Brep=item_5, Density=-1)
orient = Orient(Source=pl_3pt_2, Target=pl_3pt)  # -> Geometry, Transform
pt_9 = Point("{0.95, 0.05, 0}")
merge_2 = Merge(Data1=pt_9, Data2=pt_7, Data3=pt_8)
evalsrf_2 = EvaluateSurface(Surface=reparameterize(flip_4.Surface), Point=merge_2)  # -> Point, Normal, UDirection, VDirection, Frame
unroll_brep_2 = UnrollBrep(Brep=flip_4.Surface, Points=evalsrf_2.Point)  # -> flatten(Brep), Curves, Points
item_6 = ListItem(List=evalsrf_2.Point, Index=0, Wrap=True)  # -> Item, Item1, Item2
item_7 = ListItem(List=wires_2, Index=0, Wrap=True)  # -> Item, Item1, Item2, Item3
wires_3 = BrepWireframe(Brep=flip_4.Surface, Density=-1)
item_8 = ListItem(List=unroll_brep_2.Points, Index=0, Wrap=True)  # -> Item, Item1, Item2
pt_10 = Point(item_6.Item)
pl_3pt_3 = Plane3Pt(PointA=item_6.Item, PointB=item_6.Item1, PointC=item_6.Item2)
pl_3pt_4 = Plane3Pt(PointA=item_8.Item, PointB=item_8.Item1, PointC=item_8.Item2)
item_9 = ListItem(List=unroll_brep_2.Brep, Index=0, Wrap=True)
panel_4 = Panel(pt_6)
merge_3 = Merge(Data1=item_7.Item1, Data2=item_7.Item3)
side = Curve(merge_3)
wires_4 = BrepWireframe(Brep=item_9, Density=-1)
niche = Curve(item_7.Item)
schov = Curve(item_7.Item2)
orient_2 = Orient(Source=pl_3pt_4, Target=pl_3pt_3)  # -> Geometry, Transform
item_10 = ListItem(List=wires_4, Index=0, Wrap=True)  # -> Item, Item1, Item2, Item3
simple_bend_side = GhPythonScript(radius=Slider(0.8, range=0..1), param=Slider(0.5, range=0..1))  # -> out, a
# ---------- simple_bend_side: Python ----------
__author__ = "sofyadobycina"

import rhinoscriptsyntax as rs
import math



def tri_offset(rad):
    b = math.tan(math.pi/4)

    tri_offset = rad / b
    return tri_offset

    
a = tri_offset(radius) + param
print(a)
# ---------- end simple_bend_side ----------
simple_bend_side_2 = GhPythonScript(radius=Slider(0.8, range=0..1), param=Slider(0, range=0..1))  # -> out, a; same code as simple_bend_side
merge_4 = Merge(Data1=item_10.Item1, Data2=item_10.Item3)

# ---- group: offset 0.5 + dist between panels
addition = Addition(A=Slider(0.5, range=0..1), B=Slider(0.5, range=0..1))
neg = Negative(Value=addition)
offcrv = OffsetCurve(Curve=side, Plane=PlaneXY(0, 0, 0), Distance=neg, BothSides=0, Kinks=0, CapType=Slider(0, range=0..100))  # -> flatten(Offset)
item_11 = ListItem(List=offcrv, Index=0, Wrap=True)  # -> Item, Item1

# ----
niche_2 = Curve(item_10.Item2)
side_2 = Curve(merge_4)
schov_2 = Curve(item_10.Item)

# ---- group: offset 0.5
neg_2 = Negative(Value=Slider(0.5, range=0..1))
offcrv_2 = OffsetCurve(Curve=niche, Plane=PlaneXY(0, 0, 0), Distance=neg_2, BothSides=0, Kinks=0, CapType=Slider(0, range=0..100))  # -> flatten(Offset)

# ---- group: no bend side 1.25 offset
neg_3 = Negative(Value=Slider(1.25, range=0..10))
offcrv_3 = OffsetCurve(Curve=schov, Plane=PlaneXY(0, 0, 0), Distance=neg_3, BothSides=0, Kinks=0, CapType=Slider(0, range=0..100))  # -> flatten(Offset)

# ----
simple_bend_side_3 = GhPythonScript(radius=Slider(0.8, range=0..1), param=Slider(0.5, range=0..1))  # -> out, a; same code as simple_bend_side
simple_bend_side_4 = GhPythonScript(radius=Slider(0.8, range=0..1), param=Slider(0, range=0..1))  # -> out, a; same code as simple_bend_side

# ---- group: offset 0.5 + dist between panels
addition_2 = Addition(A=Slider(0.5, range=0..1), B=Slider(0.5, range=0..1))
neg_4 = Negative(Value=addition_2)
offcrv_4 = OffsetCurve(Curve=side_2, Plane=PlaneXY(0, 0, 0), Distance=neg_4, BothSides=0, Kinks=0, CapType=Slider(0, range=0..100))  # -> flatten(Offset)
item_12 = ListItem(List=offcrv_4, Index=0, Wrap=True)  # -> Item, Item1

# ---- group: offset 0.5
neg_5 = Negative(Value=Slider(0.5, range=0..1))
offcrv_5 = OffsetCurve(Curve=niche_2, Plane=PlaneXY(0, 0, 0), Distance=neg_5, BothSides=0, Kinks=0, CapType=Slider(0, range=0..100))  # -> flatten(Offset)

# ---- group: no bend side 1.25 offset
neg_6 = Negative(Value=Slider(1.25, range=0..10))
offcrv_6 = OffsetCurve(Curve=schov_2, Plane=PlaneXY(0, 0, 0), Distance=neg_6, BothSides=0, Kinks=0, CapType=Slider(0, range=0..100))  # -> flatten(Offset)

# ----
merge_5 = Merge(Data1=offcrv_3, Data2=offcrv_2, Data3=item_11.Item, Data4=item_11.Item1)
python_2 = GhPythonScript(crv=merge_5)  # -> out, new_crv; inputs crv: list of Curve
# ---------- python_2: Python ----------
__author__ = "sofyadobycina"

import rhinoscriptsyntax as rs
import Rhino.Geometry as rh
import ghpythonlib.components as gh

new_crv=[]

for i, v in enumerate(crv):
    param =[]
    for ind, val in enumerate(crv):
        if i != ind:
            inters = rs.CurveCurveIntersection(v,val)
            if inters is not None:
                param.append(inters[0][5])
    param = sorted(param)
    trimed = rh.Curve.Trim(v, param[0], param[1])
    new_crv.append(trimed)
# ---------- end python_2 ----------
item_13 = ListItem(List=python_2.new_crv, Index=0, Wrap=True)  # -> Item, Item1, Item2, Item3
merge_6 = Merge(Data1=offcrv_6, Data2=offcrv_5, Data3=item_12.Item, Data4=item_12.Item1)
python_3 = GhPythonScript(crv=merge_6)  # -> out, new_crv; inputs crv: list of Curve; same code as python_2
python_4 = GhPythonScript(length=Slider(35, range=0..100), angle=Slider(30, range=0..100))  # -> out, res; inputs length: list
# ---------- python_4: Python ----------
__author__ = "sofyadobycina"

import rhinoscriptsyntax as rs
import Rhino.Geometry as rh
import ghpythonlib.components as gh
import math


res = []
for l in length:
    res.append(l / math.tan(math.radians(angle)))
print(res)
# ---------- end python_4 ----------
item_14 = ListItem(List=python_3.new_crv, Index=0, Wrap=True)  # -> Item, Item1, Item2, Item3
panel_5 = Panel(python_4.res)
merge_7 = Merge(Data1=item_13.Item2, Data2=item_13.Item3)
python_5 = GhPythonScript(length=Slider(35, range=0..100), angle=Slider(30, range=0..100))  # -> out, res; inputs length: list; same code as python_4
merge_8 = Merge(Data1=item_14.Item2, Data2=item_14.Item3)
panel_6 = Panel(python_5.res)
merge_9 = Merge(Data1=item_13.Item1, Data2=item_13.Item2, Data3=item_13.Item3)
panel_7 = Panel("""45
90
90""")
join = JoinCurves(Curves=merge_9, Preserve=False)
previewlw = CustomPreviewLineweights(Geometry=merge_9, Shader=ColourSwatch(SwatchColor=RGB(255, 132, 0)), Thickness=Slider(4, range=0..10), Absolute=False)
offset = OffsetCurve(Curve=offcrv_3, Distance=Slider(23.75, range=0..100), Corners=1)
number_slider = Slider(0.5, range=0..1)
merge_10 = Merge(Data1=item_14.Item1, Data2=item_14.Item2, Data3=item_14.Item3)
number_slider_2 = Slider(0.8, range=0..1)
panel_8 = Panel("""45
90
90""")
neg_7 = Negative(Value=Slider(23.75, range=0..100))
join_2 = JoinCurves(Curves=merge_10, Preserve=False)
fres_line = GhPythonScript(angle=panel_7, met_left=number_slider, radius=number_slider_2)  # -> out, straight_len; inputs angle: list
# ---------- fres_line: Python ----------
__author__ = "sofyadobycina"

import rhinoscriptsyntax as rs
import math
param = 0.5

straight_len = []

in_rad = radius - met_left
rad = met_left * param + in_rad

for ang in angle:
    straight_len.append((2 * math.pi * rad) * (math.radians(180-ang) / (2 * math.pi))/2)
# ---------- end fres_line ----------
offset_2 = OffsetCurve(Curve=item_14.Item, Distance=neg_7, Corners=1)
number_slider_3 = Slider(57, range=0..100)
previewlw_2 = CustomPreviewLineweights(Geometry=join_2, Shader=ColourSwatch(SwatchColor=RGB(255, 132, 0)), Thickness=Slider(4, range=0..10), Absolute=False)
number_slider_4 = Slider(0.5, range=0..1)
merge_11 = Merge(Data1=item_13.Item, Data2=merge_9)
number_slider_5 = Slider(57, range=0..100)
number_slider_6 = Slider(0.8, range=0..1)
merge_12 = Merge(Data1=item_14.Item2, Data2=item_14.Item3)
ext = ExtendCurve(Curve=offset, Type=0, Start=number_slider_3, End=number_slider_3)
fres_line_2 = GhPythonScript(angle=panel_8, met_left=number_slider_4, radius=number_slider_6)  # -> out, straight_len; inputs angle: list; same code as fres_line

# ---- group: outer_len + 0.5
zub_line = GhPythonScript(angle="45", met_left=number_slider, radius=number_slider_2)  # -> out, straight_len
# ---------- zub_line: Python ----------
__author__ = "sofyadobycina"

import rhinoscriptsyntax as rs
import math
param = 0.5

metal_width = 3 

in_rad = radius - met_left
rad = met_left * param + in_rad

ang = math.radians(angle / 2)
l_out = (metal_width - met_left) / math.tan(ang)

#straight_len = ((2 * math.pi * rad) * (math.radians(180-angle) / (2 * math.pi)))+l_out
straight_len = l_out + 0.5
print (straight_len)
# ---------- end zub_line ----------

# ----
neg_8 = Negative(Value=number_slider_5)
ccx = CurveCurve(CurveA=merge_7, CurveB=ext)  # -> Points, ParamsA, flatten(ParamsB)
shatter = Shatter(Curve=ext, Parameters=ccx.ParamsB)
merge_13 = Merge(Data1=item_14.Item, Data2=merge_10)
ext_2 = ExtendCurve(Curve=offset_2, Type=0, Start=number_slider_5, End=number_slider_5)
item_15 = ListItem(List=shatter, Index=Slider(1, range=0..1), Wrap=True)
ccx_2 = CurveCurve(CurveA=merge_12, CurveB=ext_2)  # -> Points, ParamsA, flatten(ParamsB)

# ---- group: outer_len + 0.5
zub_line_2 = GhPythonScript(angle="45", met_left=number_slider_4, radius=number_slider_6)  # -> out, straight_len; same code as zub_line

# ----
boundary = BoundarySurfaces(Edges=merge_11)
end = EndPoints(Curve=item_15)  # -> Start, End
panel_9 = Panel("""1
2""")
shatter_2 = Shatter(Curve=ext_2, Parameters=ccx_2.ParamsB)
merge_14 = Merge(Data1=end.Start, Data2=end.End)
item_16 = ListItem(List=shatter_2, Index=Slider(1, range=0..1), Wrap=True)
item_17 = ListItem(List=merge_9, Index=panel_9, Wrap=True)
crv_2 = Curve([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])
boundary_2 = BoundarySurfaces(Edges=merge_13)
crv_cp = CurveClosestPoint(Point=merge_14, Curve=item_17)  # -> Point, Parameter, Distance
hframe = HorizontalFrame(Curve=item_17, Parameter=crv_cp.Parameter)
deplane = DeconstructPlane(Plane=hframe)  # -> Origin, XAxis, YAxis, ZAxis
multiplication = Multiplication(A=deplane.YAxis, B=Slider(34, range=0..100))
group = Group(Objects=crv_2)
X = UnitX(Factor=1)
move = Move(Geometry=crv_cp.Point, Motion=multiplication)  # -> Geometry, Transform
project = ProjectPoint(Point=move.Geometry, Direction=deplane.XAxis, Geometry=item_15)  # -> Point, Index
pt_11 = Point(Point(0, 0, 0))
rev = Reverse(Vector=X)
crv_cp_2 = CurveClosestPoint(Point=project.Point, Curve=item_15)  # -> Point, Parameter, Distance
shatter_3 = Shatter(Curve=item_15, Parameters=crv_cp_2.Parameter)
item_18 = ListItem(List=shatter_3, Index=Slider(1, range=0..1), Wrap=True)
len = Length(Curve=item_18)
division = Division(A=len, B=Slider(100, range=0..100))
round = Round(Number=division)  # -> Nearest, Floor, Ceiling
divide = DivideCurve(Curve=item_18, Count=round.Ceiling, Kinks=False)  # -> Points, Tangents, Parameters
vec2pt = Vector2Pt(PointA=pt_11, PointB=divide.Points, Unitize=False)  # -> Vector, Length
project_2 = ProjectPoint(Point=divide.Points, Direction=rev, Geometry=item_16)  # -> Point, Index
move_2 = Move(Geometry=group, Motion=vec2pt.Vector)  # -> Geometry, Transform
vec2pt_2 = Vector2Pt(PointA=pt_11, PointB=project_2.Point, Unitize=False)  # -> Vector, Length
pt_12 = Point(Point(0, 3.166488276, 0))
pt_13 = Point(Point(-11.5, 29.0011855, 0))
move_3 = Move(Geometry=group, Motion=vec2pt_2.Vector)  # -> Geometry, Transform
previewlw_3 = CustomPreviewLineweights(
    Geometry=move_2.Geometry,
    Shader=ColourSwatch(SwatchColor=RGB(21, 255, 0)),
    Thickness=Slider(4, range=0..10),
    Absolute=False)
pdecon = Deconstruct(Point=pt_12)  # -> XComponent, YComponent, ZComponent
pdecon_2 = Deconstruct(Point=pt_13)  # -> XComponent, YComponent, ZComponent
number_slider_7 = Slider(1.5, range=0..10)
subtraction = Subtraction(A=pdecon.YComponent)
pt_14 = Point(Point(-6.5, 29.0011855, 0))
previewlw_4 = CustomPreviewLineweights(
    Geometry=move_3.Geometry,
    Shader=ColourSwatch(SwatchColor=RGB(21, 255, 0)),
    Thickness=Slider(4, range=0..10),
    Absolute=False)
addition_3 = Addition(A=number_slider_7, B=Slider(0.5, range=0..10))
pdecon_3 = Deconstruct(Point=pt_14)  # -> XComponent, YComponent, ZComponent
pt_15 = Point(Point(0, 3.166488276, 0))
pt_16 = ConstructPoint(XCoordinate=pdecon.XComponent, YCoordinate=addition_3, ZCoordinate=0)
python_6 = GhPythonScript()  # -> out, a
# ---------- python_6: Python ----------
__author__ = "andrewastakhov"

import rhinoscriptsyntax as rs




class rhinoble(object):
    
    
    @classmethod
    def point_handler(cls, poin3d):
        yield poin3d.X, poin3d.Y, poin3d.Z
    
    
    
    @classmethod
    def iter_point_handler(cls, *poins3d):
        llist=[]
        for point3d in poins3d:
            llist.extend(cls.point_handler(point3d))
        return llist

class Triangle(rhinoble):
    def __init__(self, a, b, c):
        self.a, self.b, self.c =  a, b, c
        self.arc=self.get_arc()
    def __repr__(self):
        
        crdlist = list(itertools.chain(*self.iter_point_handler(self.a, self.b, self.c)))
        print crdlist
        tt = str()
        for p in crdlist:
            tt += str(p)
        
        str_ = '<Triangle object at {}>'.format(tt)

        print tt
        return str_
    def get_circle(self):
        return Rhino.Geometry.Circle(self.a, self.b, self.c)
    def get_arc(self):
        return Rhino.Geometry.Arc(self.a, self.b, self.c)


# end module $

cd = ghenv.Component.Code.partition("$")[0]
print(cd)
def exec_local_module(code, requirements, module_name="__builtin__"):
    
    import sys
    import types
    
    module = types.ModuleType(module_name, 'The {} module'.format( module_name))
    for n, req in requirements.items():
        module .__dict__[n]=__import__(req)
    sys.modules[module_name] = module 
    print sys.modules[module_name]
    code = compile(cd, '<string>', 'exec')
    exec code in module .__dict__
    return module

mdl = exec_local_module(cd, {'Rhino':'Rhino','itertools':'itertools'})
import Rhino
aa = Rhino.Geometry.Point3d(2,4,1)
bb = Rhino.Geometry.Point3d(1,3,5)
cc = Rhino.Geometry.Point3d(3,1,9)
print mdl.Triangle(aa, bb, cc)
# ---------- end python_6 ----------
cir = Circle(Plane=pt_16, Radius=number_slider_7)
code_2 = Code("""\"\"\"Provides a scripting component.
    Inputs:
        x: The x script variable
        y: The y script variable
    Output:
        a: The a output variable\"\"\"

__author__ = "andrewastakhov"

DUMP_NAME = "ghoutput"
DUMP_FP = "/Users/{}/dumps/{}.json".format(__author__, DUMP_NAME)

import rhinoscriptsyntax as rs
import json
from ghpythonlib.treehelpers import list_to_tree
import Rhino.Geometry as rg

def d(x, y):
    for i, j in zip(x, y):
        yield [i.From.X, i.From.Y],[j.From.X, j.From.Y]

def file_dump(data, fp=DUMP_FP):
    f = open(fp, "wb")
    json.dump(data, f)
    f.close()


data = {
    "lines": list(d(x,y))
}

a = json.dumps(data)

if dump:
    file_dump(data)""")
pt_17 = Point(Point(-11.5, 29.0011855, 0))
pdecon_4 = Deconstruct(Point=pt_15)  # -> XComponent, YComponent, ZComponent
pdecon_5 = Deconstruct(Point=pt_17)  # -> XComponent, YComponent, ZComponent
number_slider_8 = Slider(1.5, range=0..10)
subtraction_2 = Subtraction(A=pdecon_4.YComponent)
pt_18 = Point(Point(-6.5, 29.0011855, 0))
addition_4 = Addition(A=number_slider_8, B=Slider(0.5, range=0..10))
pdecon_6 = Deconstruct(Point=pt_18)  # -> XComponent, YComponent, ZComponent
pt_19 = ConstructPoint(XCoordinate=pdecon_4.XComponent, YCoordinate=addition_4, ZCoordinate=0)
python_7 = GhPythonScript()  # -> out, a; same code as python_6
cir_2 = Circle(Plane=pt_19, Radius=number_slider_8)
code_3 = Code("""\"\"\"Provides a scripting component.
    Inputs:
        x: The x script variable
        y: The y script variable
    Output:
        a: The a output variable\"\"\"

__author__ = "andrewastakhov"

DUMP_NAME = "ghoutput"
DUMP_FP = "/Users/{}/dumps/{}.json".format(__author__, DUMP_NAME)

import rhinoscriptsyntax as rs
import json
from ghpythonlib.treehelpers import list_to_tree
import Rhino.Geometry as rg

def d(x, y):
    for i, j in zip(x, y):
        yield [i.From.X, i.From.Y],[j.From.X, j.From.Y]

def file_dump(data, fp=DUMP_FP):
    f = open(fp, "wb")
    json.dump(data, f)
    f.close()


data = {
    "lines": list(d(x,y))
}

a = json.dumps(data)

if dump:
    file_dump(data)""")
pt_20 = Point(Point(0, 3.166488276, 0))
pt_21 = Point(Point(-6.5, 29.0011855, 0))
pdecon_7 = Deconstruct(Point=pt_20)  # -> XComponent, YComponent, ZComponent
pdecon_8 = Deconstruct(Point=pt_13)  # -> XComponent, YComponent, ZComponent
number_slider_9 = Slider(1.5, range=0..10)
subtraction_3 = Subtraction(A=pdecon_7.YComponent)
addition_5 = Addition(A=number_slider_9, B=Slider(0.5, range=0..10))
pt_22 = Point(Point(0, 3.166488276, 0))
pdecon_9 = Deconstruct(Point=pt_21)  # -> XComponent, YComponent, ZComponent
pt_23 = ConstructPoint(XCoordinate=pdecon_7.XComponent, YCoordinate=addition_5, ZCoordinate=0)
cir_3 = Circle(Plane=pt_23, Radius=number_slider_9)
wires_5 = BrepWireframe(Brep=boundary, Density=-1)  # -> flatten(Wireframe)
code_4 = Code("""\"\"\"Provides a scripting component.
    Inputs:
        x: The x script variable
        y: The y script variable
    Output:
        a: The a output variable\"\"\"

__author__ = "andrewastakhov"

DUMP_NAME = "ghoutput"
DUMP_FP = "/Users/{}/dumps/{}.json".format(__author__, DUMP_NAME)

import rhinoscriptsyntax as rs
import json
from ghpythonlib.treehelpers import list_to_tree
import Rhino.Geometry as rg

def d(x, y):
    for i, j in zip(x, y):
        yield [i.From.X, i.From.Y],[j.From.X, j.From.Y]

def file_dump(data, fp=DUMP_FP):
    f = open(fp, "wb")
    json.dump(data, f)
    f.close()


data = {
    "lines": list(d(x,y))
}

a = json.dumps(data)

if dump:
    file_dump(data)""")
pt_24 = Point(Point(-6.5, 29.0011855, 0))
pdecon_10 = Deconstruct(Point=pt_22)  # -> XComponent, YComponent, ZComponent
pdecon_11 = Deconstruct(Point=pt_17)  # -> XComponent, YComponent, ZComponent
pt_25 = Point(Point(0, 0, 0))
number_slider_10 = Slider(1.5, range=0..10)
subtraction_4 = Subtraction(A=pdecon_10.YComponent)
addition_6 = Addition(A=number_slider_10, B=Slider(0.5, range=0..10))
pdecon_12 = Deconstruct(Point=pt_24)  # -> XComponent, YComponent, ZComponent
pt_26 = ConstructPoint(XCoordinate=pdecon_10.XComponent, YCoordinate=addition_6, ZCoordinate=0)
wires_6 = BrepWireframe(Brep=boundary_2, Density=-1)  # -> flatten(Wireframe)
cir_4 = Circle(Plane=pt_26, Radius=number_slider_10)
number_slider_11 = Slider(2, range=0..10)
code_5 = Code("""\"\"\"Provides a scripting component.
    Inputs:
        x: The x script variable
        y: The y script variable
    Output:
        a: The a output variable\"\"\"

__author__ = "andrewastakhov"

DUMP_NAME = "ghoutput"
DUMP_FP = "/Users/{}/dumps/{}.json".format(__author__, DUMP_NAME)

import rhinoscriptsyntax as rs
import json
from ghpythonlib.treehelpers import list_to_tree
import Rhino.Geometry as rg

def d(x, y):
    for i, j in zip(x, y):
        yield [i.From.X, i.From.Y],[j.From.X, j.From.Y]

def file_dump(data, fp=DUMP_FP):
    f = open(fp, "wb")
    json.dump(data, f)
    f.close()


data = {
    "lines": list(d(x,y))
}

a = json.dumps(data)

if dump:
    file_dump(data)""")
pt_27 = Point(Point(0, 0, 0))
number_slider_12 = Slider(54, range=0..100)
number_slider_13 = Slider(2, range=0..10)
number_slider_14 = Slider(54, range=0..100)
panel_10 = Panel("""0
-1""")
panel_11 = Panel("""0
-1""")
transform = Transform(Geometry=merge_9, Transform=orient.Transform)
previewlw_5 = CustomPreviewLineweights(Geometry=transform, Shader=ColourSwatch(SwatchColor=RGB(255, 0, 0)), Thickness=Slider(2, range=0..10), Absolute=False)
transform_2 = Transform(Geometry=merge_10, Transform=orient_2.Transform)
previewlw_6 = CustomPreviewLineweights(Geometry=transform_2, Shader=ColourSwatch(SwatchColor=RGB(255, 0, 0)), Thickness=Slider(2, range=0..10), Absolute=False)

len_2 = Length(Curve=item_13.Item3)
len_3 = Length(Curve=item_13.Item1)
len_4 = Length(Curve=item_13.Item2)
subtraction_5 = Subtraction(A=len_3, B=python_4.res)
merge_15 = Merge(Data1=python_4.res, Data2=len_4)
merge_16 = Merge(Data1=python_4.res, Data2=subtraction_5)
eval = EvaluateLength(Curve=item_13.Item1, Length=merge_16, Normalized=False)  # -> Point, Tangent, flatten(Parameter)
eval_2 = EvaluateLength(Curve=item_13.Item2, Length=merge_15, Normalized=False)  # -> Point, Tangent, flatten(Parameter)
number_slider_15 = Slider(35, range=0..100)

subtraction_6 = Subtraction(A=len_2, B=python_4.res)

merge_17 = Merge(Data1=Slider(0, range=0..100), Data2=subtraction_6)
eval_3 = EvaluateLength(Curve=item_13.Item3, Length=merge_17, Normalized=False)  # -> Point, Tangent, flatten(Parameter)
merge_18 = Merge(Data1=eval.Parameter, Data2=eval_2.Parameter, Data3=eval_3.Parameter)
partition = PartitionList(List=merge_18, Size=Slider(2, range=0..10))
sort = SortList(Keys=partition, ValuesA=partition)  # -> Keys, ValuesA
python_8 = GhPythonScript(crv=merge_9, params=sort.ValuesA)  # -> out, new_crv; inputs crv: list of Curve, params: tree
# ---------- python_8: Python ----------
__author__ = "sofyadobycina"

import rhinoscriptsyntax as rs
import Rhino.Geometry as rh
import ghpythonlib.treehelpers as th

new_crv=[]
params = th.tree_to_list(params)


for i, v in enumerate(crv):
    trimed = rh.Curve.Trim(v, params[i][0], params[i][1])
    new_crv.append(trimed)
# ---------- end python_8 ----------
offcrv_7 = OffsetCurve(
    Curve=python_8.new_crv,
    Plane=PlaneXY(0, 0, 0),
    Distance=number_slider_15,
    BothSides=0,
    Kinks=0,
    CapType=Slider(0, range=0..100))  # -> flatten(Offset)

addition_7 = Addition(A=number_slider_15, B=fres_line.straight_len)
rulesrf = RuledSurface(CurveA=merge_9, CurveB=offcrv_7)
item_19 = ListItem(List=rulesrf, Index=0, Wrap=True)
subtraction_7 = Subtraction(A=number_slider_15, B=zub_line.straight_len)
wires_7 = BrepWireframe(Brep=rulesrf, Density=-1)
neg_9 = Negative(Value=subtraction_7)
offsets = OffsetOnSrf(Curve=item_13.Item1, Distance=zub_line.straight_len, Surface=item_19)  # -> flatten(Curve)
offset_3 = OffsetCurve(Curve=offsets, Distance=subtraction_7, Corners=1)
divide_2 = DivideCurve(Curve=offsets, Count=Slider(2, range=0..10), Kinks=False)  # -> Points, Tangents, Parameters
rulesrf_2 = RuledSurface(CurveA=offsets, CurveB=offset_3)
item_20 = ListItem(List=divide_2.Points, Index=0, Wrap=True)  # -> Item, Item1, Item2
arc = Arc3Pt(PointA=item_20.Item, PointB=item_20.Item1, PointC=item_20.Item2)  # -> Arc, Plane, Radius
dim = Dimensions(Surface=rulesrf_2)  # -> UDimension, VDimension
dim_2 = Dimensions(Surface=rulesrf_2)  # -> UDimension, VDimension
panel_12 = Panel(dim.VDimension)
pt_28 = ConstructPoint(XCoordinate=pdecon_2.XComponent, YCoordinate=dim.VDimension, ZCoordinate=0)
pt_29 = ConstructPoint(XCoordinate=pdecon_3.XComponent, YCoordinate=dim.VDimension, ZCoordinate=0)
python_9 = GhPythonScript(x=pt_29, y=pt_28, z=cir)  # -> out, a; inputs x: Point3d, y: Point3d
# ---------- python_9: Python ----------
__author__ = "andrewastakhov"

DUMP_NAME = "ghoutput"
DUMP_FP = "/Users/{}/dumps/{}.json".format(__author__, DUMP_NAME)

import rhinoscriptsyntax as rs
import json
import Rhino
import ghpythonlib.components as ghc
import copy
import Rhino.Geometry as rg

class TT:
    
    def __init__(self,pt,pt2, circle, w=15, hole=3.5):
        self.name = "arcpattern"
        self.w=7
        self._n=0
        self._pt=pt
        self._pt2=pt2
        self.circle=circle
        self.hole=hole
        self.ptk=rg.Point3d(0,0,0)
        self.pt2k=rg.Point3d(0,0,0)
    @property
    def pt(self):
        return self._pt+self.ptk
    @property
    def pt2(self):
        return self._pt2+self.pt2k
    @property
    def n(self):
        return self._n
    @n.setter
    def n(self,v):
        self._n=v
    @property
    def tan(self):
        t1,t2=ghc.TangentLines(self.pt,self.circle)
        return t1,t2
    @property
    def mr(self):
        return rg.Transform.Mirror(self.circle.Center, rg.Vector3d.XAxis)
        
        
    @property
    def ln(self):
        plcrv=rg.PolyCurve()
        ln1=self.tan[self.n]
        ln2=copy.deepcopy(self.tan[self.n])
        ln0=rg.Line(self.pt2, ln1.From)
        pt3=copy.deepcopy(self.pt2)
        pt3.Transform(self.mr)
        pt4=self.pt2+rg.Point3d(0,-self.w,0)
        pt5=pt4+rg.Point3d(0,-17,0)
        pt41=pt4+rg.Point3d(-self.hole/2,0,0)
        pt42=pt4+rg.Point3d(self.hole/2,0,0)
        pt51=pt5+rg.Point3d(-self.hole/2,0,0)
        pt52=pt5+rg.Point3d(self.hole/2,0,0)
        
        
        crv=[rg.Circle(pt4,self.hole/2).ToNurbsCurve(),
        rg.Circle(pt5,self.hole/2).ToNurbsCurve(),
        rg.Polyline([pt41,pt51,pt52,pt42,pt41]).ToNurbsCurve()]
        ln3=copy.deepcopy(ln0)
        ln2.Transform(self.mr)
        ln3.Transform(self.mr)
        crvu=list(rg.Curve.CreateBooleanUnion(crv))
        print ln2
        crvu.extend([ln0, ln1, rg.Arc(ln1.To,self.circle.PointAt(-0.5),endPoint=ln2.To),ln2.ToNurbsCurve(),ln3])
       
        return crvu
       



        



a=TT(x,y,z)

print a.circle
# ---------- end python_9 ----------
python_10 = GhPythonScript(x=python_9.a, y=dim_2.UDimension)  # -> out, a
# ---------- python_10: Python ----------
__author__ = "andrewastakhov"

import rhinoscriptsyntax as rs

import cPickle as pickle
import os



import rhinoscriptsyntax as rs
import Rhino.Geometry as rg
import copy
class Ptrn:
    def __init__(self, itr):
        self.itr=itr
    
    def __getitem__(self, itm):
        return self.itr.__getitem__(itm)
    def __setitem__(self, itm,v):
        self.itr.__setitem__(itm,v)   
    def __len__(self):
        return len(self.itr)
class Pattern:
    def __init__(self, unit, modl=23, l=1000):
        self.__unit=unit
        self.name="pattern_arc"
        self.unit=copy.deepcopy(unit)
        self.u=self.unit.ln
        self.modl=modl
        self.l=l
        self.ln=l//modl
        print(self.ln)
    def __iter__(self ):
        return self
    @property
    def trsf(self):
        return rg.Transform.Translation(self.modl, 0,0)
        
    def mtr(self):
        for i in self.u:
            
            i.Transform(self.trsf)
        return self.u
    def next(self):
        if self.constrain():
            self.l-=self.modl
            print(self.ln)
            return copy.deepcopy(self.mtr())
        else:
            raise StopIteration
           
    
    
    def constrain(self):
        
        return abs(self.l-self.modl)>20
    def reload(self):
        
        self.unit=copy.deepcopy(self.__unit)
        self.u=self.unit.ln
        self.ln=self.l//self.modl
        print( self.ln)
    
a=x.ln
# ---------- end python_10 ----------
python_11 = GhPythonScript(x=python_9.a, y=dim_2.UDimension)  # -> out, a
# ---------- python_11: Python ----------
__author__ = "andrewastakhov"

import rhinoscriptsyntax as rs

import cPickle as pickle
import os



import rhinoscriptsyntax as rs
import Rhino.Geometry as rg
import copy
class Ptrn:
    def __init__(self, itr):
        self.itr=itr
    
    def __getitem__(self, itm):
        return self.itr.__getitem__(itm)
    def __setitem__(self, itm,v):
        self.itr.__setitem__(itm,v)   
    def __len__(self):
        return len(self.itr)
class Pattern:
    def __init__(self, unit, modl=23, l=1000):
        self.__unit=unit
        self.name="pattern_arc"
        self.unit=copy.deepcopy(unit)
        self.u=self.unit.ln
        self.modl=modl
        self.l=l
        self.ln=l//modl
        print(self.ln)
    def __iter__(self ):
        return self
    @property
    def trsf(self):
        return rg.Transform.Translation(self.modl, 0,0)
        
    def mtr(self):
        for i in self.u:
            
            i.Transform(self.trsf)
        return self.u
    def next(self):
        if self.constrain():
            self.l-=self.modl
            print(self.ln)
            return copy.deepcopy(self.mtr())
        else:
            raise StopIteration
           
    
    
    def constrain(self):
        
        return abs(self.l-self.modl)>20
    def reload(self):
        
        self.unit=copy.deepcopy(self.__unit)
        self.u=self.unit.ln
        self.ln=self.l//self.modl
        print( self.ln)
    
a=Pattern(x,23,y)
# ---------- end python_11 ----------
python_12 = GhPythonScript(x=python_11.a)  # -> out, a; inputs x: list
# ---------- python_12: Python ----------
import itertools
__author__ = "admin"
__version__ = "2022.10.03"
import ghpythonlib.treehelpers as th
import rhinoscriptsyntax as rs
import copy
ans=[]
for ii in x:
    ll=[i for i in copy.deepcopy(ii)]
    aans=[]
    aans.extend(ll[0][4:6])
    aans.extend(ll[1:][:-1])
    aans.extend(ll[-1][1:-3])
    ans.append(aans)
a=th.list_to_tree(ans, none_and_holes=False)
# ---------- end python_12 ----------
join_3 = JoinCurves(Curves=python_12.a, Preserve=False)
group_2 = Group(Objects=join_3)
pshift = ShiftPaths(Data=group_2, Offset=Slider(2, range=0..10))
group_3 = Group(Objects=pshift)  # -> flatten(Group)
ungroup = Ungroup(Group=group_3)
pt_30 = ConstructPoint(XCoordinate=pdecon_8.XComponent, YCoordinate=dim.VDimension, ZCoordinate=0)
flip_5 = FlipMatrix(Data=ungroup)
ungroup_2 = Ungroup(Group=flip_5)
bang = ExplodeTree(Data=wires_7)  # -> Branch0, Branch1, Branch2
cluster = Cluster(G=flip_5)
brec = BoundingRectangle(Geometry=cluster, Plane=PlaneXY(0, 0, 0), Axis=0, Slide=0, Union=True)  # -> Bounding, DimensionX, DimensionY
subtraction_8 = Subtraction(A=brec.DimensionX, B=dim.UDimension)
division_2 = Division(A=subtraction_8, B=Slider(2, range=0..10))
extendsrf = ExtendSurface(Surface=rulesrf_2, WestEdge=division_2, SouthEdge=0, EastEdge=division_2, NorthEdge=0, ExtensionType=True)
ext_3 = ExtendCurve(Curve=offsets, Type=0, Start=division_2, End=division_2)
offset_4 = OffsetCurve(Curve=ext_3, Distance=subtraction_7, Corners=1)
cpoly = ControlPolygon(Curve=brec.Bounding)  # -> Polygon, Points
trim = TrimTree(Tree=ungroup_2, Depth=1)
pt_31 = ConstructPoint(XCoordinate=pdecon_9.XComponent, YCoordinate=dim.VDimension, ZCoordinate=0)
srf = Surface(rulesrf_2)
item_21 = ListItem(List=cpoly.Points, Index=0, Wrap=True)
join_4 = JoinCurves(Curves=trim, Preserve=False)
X_2 = UnitX(Factor=brec.DimensionX)
merge_19 = Merge(Data1=bang.Branch1, Data2=bang.Branch2)  # -> flatten(Result)
python_13 = GhPythonScript(x=pt_31, y=pt_30, z=cir_3)  # -> out, a; inputs x: Point3d, y: Point3d
# ---------- python_13: Python ----------
__author__ = "andrewastakhov"

DUMP_NAME = "ghoutput"
DUMP_FP = "/Users/{}/dumps/{}.json".format(__author__, DUMP_NAME)

import rhinoscriptsyntax as rs
import json
import Rhino
import ghpythonlib.components as ghc
import copy
import Rhino.Geometry as rg

class TT:
    
    def __init__(self,pt,pt2, circle, w=15, hole=3.5):
        self.name = "arcpattern"
        self.w=6.672
        self.fh=5.872
        self._n=0
        self._pt=pt
        self._pt2=pt2
        self.circle=circle
        self.hole=hole
        self.ptk=rg.Point3d(0,0,0)
        self.pt2k=rg.Point3d(0,0,0)
        self.contour=None
        self.holes =None
        self.ln
    @property
    def pt(self):
        return self._pt+self.ptk
    @property
    def pt2(self):
        return self._pt2+self.pt2k
    @property
    def n(self):
        return self._n
    @n.setter
    def n(self,v):
        self._n=v
    @property
    def tan(self):
        t1,t2=ghc.TangentLines(self.pt,self.circle)
        return t1,t2
    @property
    def mr(self):
        return rg.Transform.Mirror(self.circle.Center, rg.Vector3d.XAxis)
        
        
    @property
    def ln(self):
        plcrv=rg.PolyCurve()
        ln1=self.tan[self.n]
        ln2=copy.deepcopy(self.tan[self.n])
        ln0=rg.Line(self.pt2, ln1.From)
        pt3=copy.deepcopy(self.pt2)
        pt3.Transform(self.mr)
        pt6=self.pt2+rg.Point3d(0,-self.w,0)
        pt4=self.pt2+rg.Point3d(0,-self.w-self.fh,0)
        pt5=pt4+rg.Point3d(0,-19.067-(7-6.672)+self.fh,0) 
        pt41=pt4+rg.Point3d(-self.hole/2,0,0)
        pt42=pt4+rg.Point3d(self.hole/2,0,0)
        pt51=pt5+rg.Point3d(-self.hole/2,0,0)
        pt52=pt5+rg.Point3d(self.hole/2,0,0)
        print pt5
        
        crv=[
            rg.Circle(pt4,self.hole/2).ToNurbsCurve(),
            rg.Circle(pt6,self.hole/2).ToNurbsCurve(),
            rg.Circle(pt5,self.hole/2).ToNurbsCurve(),
            rg.Polyline([pt41,pt51,pt52,pt42,pt41]).ToNurbsCurve()]
        ln3=copy.deepcopy(ln0)
        ln2.Transform(self.mr)
        ln3.Transform(self.mr)
        crvu=list(rg.Curve.CreateBooleanUnion(crv))
        self.holes=copy.deepcopy(crvu)
        self.contour=rg.Curve.JoinCurves([ln0.ToNurbsCurve(), ln1.ToNurbsCurve(), rg.Arc(ln1.To,self.circle.PointAt(-0.5),endPoint=ln2.To).ToNurbsCurve(),ln2.ToNurbsCurve(),ln3.ToNurbsCurve()])[0]
        print ln2
        crvu.extend([ln0.ToNurbsCurve(), ln1.ToNurbsCurve(), rg.Arc(ln1.To,self.circle.PointAt(-0.5),endPoint=ln2.To).ToNurbsCurve(),ln2.ToNurbsCurve(),ln3.ToNurbsCurve()])
       
        return crvu
       



        



a=TT(x,y,z)

print a.circle
# ---------- end python_13 ----------
line = LineSDL(Start=item_21, Direction=X_2, Length=brec.DimensionX)
python_14 = GhPythonScript(x=python_13.a, y=dim_2.UDimension)  # -> out, a, b
# ---------- python_14: Python ----------
    
a=x.contour
b=x.holes
# ---------- end python_14 ----------
python_15 = GhPythonScript(crv=merge_19, inters_crv=wires_5)  # -> out, new_crv; inputs crv: list of Curve, inters_crv: list of Curve
# ---------- python_15: Python ----------
__author__ = "sofyadobycina"

import rhinoscriptsyntax as rs
import Rhino.Geometry as rh
import ghpythonlib.components as gh

new_crv=[]

for i, v in enumerate(crv):
    new = []
    for ind, val in enumerate(inters_crv):
        inters = rs.CurveCurveIntersection(v,val)
        
        #print(inters)
        if inters is None or inters[0][0] == 1 :
            new.append(inters)
            
        elif inters[0][0] == 2 :
            pass
    print(new)
    if len(new) == 4:
        new_crv.append(v)
# ---------- end python_15 ----------
crv_3 = Curve(bang.Branch0)
python_16 = GhPythonScript(x=python_13.a, y=dim_2.UDimension)  # -> out, a, b
# ---------- python_16: Python ----------
__author__ = "andrewastakhov"

import rhinoscriptsyntax as rs

import cPickle as pickle
import os



import rhinoscriptsyntax as rs
import Rhino.Geometry as rg
import copy
class Ptrn:
    def __init__(self):
        
        self._holes=[]
        self._contour=[]
    @property
    def holes(self):
        return self._holes
    @property
    def contour(self):
        return self._contour
    @property
    def itr(self):
        return list(zip(self.contour,self.holes))
    def __getitem__(self, itm):
        return self.itr.__getitem__(itm)
    def __setitem__(self, itm,v):
        self.itr.__setitem__(itm,v)   
    def __len__(self):
        return len(self.itr)
class Pattern:
    def __init__(self, unit, modl=23, l=1000):
        self.__unit=unit
        self.name="pattern_arc"
        self.unit=copy.deepcopy(unit)
        self.u=self.unit.contour
        self.holes=self.unit.holes
        self.modl=modl
        self.l=l
        self.ln=l//modl
        self.r=Ptrn()
        print self.u
        self.r._contour.append(copy.deepcopy(self.u))
        self.r._holes.append(copy.deepcopy(self.holes))
        print(self.ln)
    def __iter__(self ):
        return self
    @property
    def trsf(self):
        return rg.Transform.Translation(self.modl, 0,0)
        
    def mtr(self):
        print("\n")
        
        self.u.Transform(self.trsf)
        
        for i in self.holes:
            
            i.Transform(self.trsf)
        self.r._contour.append(copy.deepcopy(self.u))
        self.r._holes.append(copy.deepcopy(self.holes))
        return self.holes,self.u
    def next(self):
        if self.constrain():
            self.l-=self.modl
            print(self.ln)
            return copy.deepcopy(self.mtr())
        else:
            raise StopIteration
           
    
    def to_ptrn(self):
        self.reload()
        for i in self:
            pass
        return self.r
    def constrain(self):
        
        return abs(self.l-self.modl)>20
    def reload(self):
        
        self.unit=copy.deepcopy(self.__unit)
        self.u=self.unit.contour
        self.holes=self.unit.holes
        self.ln=self.l//self.modl
        print( self.ln)
    
a=Pattern(x,23,y)
b=a.to_ptrn()
# ---------- end python_16 ----------
join_5 = JoinCurves(Curves=crv_3, Preserve=False)
srf_2 = Surface(rulesrf_2)
python_17 = GhPythonScript(x=python_16.b)  # -> out, a, b
# ---------- python_17: Python ----------
__author__ = "andrewastakhov"

import rhinoscriptsyntax as rs
import ghpythonlib.treehelpers as th
a=th.list_to_tree(x.holes)
b=x.contour
# ---------- end python_17 ----------
join_6 = JoinCurves(Curves=python_17.b, Preserve=False)
brec_2 = BoundingRectangle(Geometry=join_6, Plane=PlaneXY(0, 0, 0), Axis=0, Slide=0, Union=True)  # -> Bounding, DimensionX, DimensionY
cpoly_2 = ControlPolygon(Curve=brec_2.Bounding)  # -> Polygon, Points
item_22 = ListItem(List=cpoly_2.Points, Index=0, Wrap=True)
srf_3 = Surface(brec_2.Bounding)
rulesrf_3 = RuledSurface(CurveA=ext_3, CurveB=offset_4)
map_srf = MapToSurface(Curve=simplify(join_6), Source=reparameterize(simplify(srf_3)), Target=reparameterize(simplify(rulesrf_3)))
ccx_3 = CurveCurve(CurveA=join_5, CurveB=map_srf)  # -> Points, ParamsA, ParamsB
alongcrv = SortAlongCurve(Points=ccx_3.Points, Curve=arc.Arc)  # -> Points, Indices
X_3 = UnitX(Factor=brec_2.DimensionX)
dim_3 = Dimensions(Surface=rulesrf_3)  # -> UDimension, VDimension
crv_4 = Curve(python_17.a)
panel_13 = Panel(crv_3)
line_2 = LineSDL(Start=item_22, Direction=X_3, Length=brec_2.DimensionX)
item_23 = ListItem(List=alongcrv.Points, Index=panel_10, Wrap=True)
map_srf_2 = MapToSurface(Curve=simplify(python_17.a), Source=reparameterize(simplify(srf_3)), Target=reparameterize(simplify(rulesrf_3)))
lng = ListLength(List=map_srf_2)
subtraction_9 = Subtraction(A=lng, B=1)
split = SplitList(List=map_srf_2, Index=subtraction_9)  # -> flatten(ListA), ListB
ccx_4 = CurveCurve(CurveA=flatten(join_5), CurveB=split.ListA)  # -> Points, ParamsA, ParamsB
tstat = TreeStatistics(Tree=ccx_4.Points)  # -> Paths, Length, Count
python_18 = GhPythonScript(x=tstat.Length)  # -> out, a; inputs x: list
# ---------- python_18: Python ----------
__author__ = "sofyadobycina"

import rhinoscriptsyntax as rs

a=[]
for i, v in enumerate(x):
    if v>0:
        a.append(i)
# ---------- end python_18 ----------
crv_cp_3 = CurveClosestPoint(Point=item_23, Curve=map_srf)  # -> Point, Parameter, Distance
crv_cp_4 = CurveClosestPoint(Point=item_23, Curve=join_5)  # -> Point, Parameter, Distance
group_4 = Group(Objects=map_srf_2)  # -> flatten(Group)
shatter_4 = Shatter(Curve=join_5, Parameters=crv_cp_4.Parameter)
crv_5 = Curve(bang.Branch0)
shatter_5 = Shatter(Curve=map_srf, Parameters=crv_cp_3.Parameter)
item_24 = ListItem(List=shatter_4, Index=Slider(1, range=0..100), Wrap=True)
python_19 = GhPythonScript(crv=crv_3, inters_crv=merge_9)  # -> out, new_crv; inputs crv: list of Curve, inters_crv: list of Curve
# ---------- python_19: Python ----------
__author__ = "sofyadobycina"

import rhinoscriptsyntax as rs
import Rhino.Geometry as rh
import ghpythonlib.components as gh

new_crv=[]

for i, v in enumerate(crv):
    new = []
    for ind, val in enumerate(inters_crv):
        inters = rs.CurveCurveIntersection(v,val)
        print(inters)
        if inters is None or inters[0][0] == 1 :
            new.append(v)
            
        elif inters[0][0] == 2 :
            pass
    if len(new) == 3:
        new_crv.append(v)
# ---------- end python_19 ----------
item_25 = ListItem(List=shatter_5, Index=Slider(1, range=0..10), Wrap=True)
explode = Explode(Curve=item_24, Recursive=True)  # -> Segments, Vertices
merge_20 = Merge(Data1=python_19.new_crv, Data2=item_25)  # -> flatten(Result)
join_7 = JoinCurves(Curves=python_19.new_crv, Preserve=False)
cull_i = CullIndex(List=group_4, Indices=Slider(0, range=0..100), Wrap=True)
merge_21 = Merge(Data1=flatten(python_15.new_crv), Data2=flatten(join_7), Data3=item_13.Item)
transform_3 = Transform(Geometry=cull_i, Transform=orient.Transform)
join_8 = JoinCurves(Curves=merge_21, Preserve=False)
transform_4 = Transform(Geometry=join_8, Transform=orient.Transform)
previewlw_7 = CustomPreviewLineweights(
    Geometry=[join_7, python_15.new_crv, item_13.Item],
    Shader=ColourSwatch(SwatchColor=RGB(255, 255, 255)),
    Thickness=Slider(4, range=0..10),
    Absolute=False)
previewlw_8 = CustomPreviewLineweights(
    Geometry=[transform_4, transform_3],
    Shader=ColourSwatch(SwatchColor=RGB(255, 255, 255)),
    Thickness=Slider(1, range=0..10),
    Absolute=False)

len_5 = Length(Curve=item_14.Item3)
len_6 = Length(Curve=item_14.Item1)
len_7 = Length(Curve=item_14.Item2)
subtraction_10 = Subtraction(A=len_6, B=python_5.res)
merge_22 = Merge(Data1=python_5.res, Data2=subtraction_10)
merge_23 = Merge(Data1=python_5.res, Data2=len_5)
eval_4 = EvaluateLength(Curve=item_14.Item3, Length=merge_23, Normalized=False)  # -> Point, Tangent, flatten(Parameter)
eval_5 = EvaluateLength(Curve=item_14.Item1, Length=merge_22, Normalized=False)  # -> Point, Tangent, flatten(Parameter)
number_slider_16 = Slider(35, range=0..100)

subtraction_11 = Subtraction(A=len_7, B=python_5.res)

merge_24 = Merge(Data1=Slider(0, range=0..100), Data2=subtraction_11)
eval_6 = EvaluateLength(Curve=item_14.Item2, Length=merge_24, Normalized=False)  # -> Point, Tangent, flatten(Parameter)
merge_25 = Merge(Data1=eval_5.Parameter, Data2=eval_6.Parameter, Data3=eval_4.Parameter)
partition_2 = PartitionList(List=merge_25, Size=Slider(2, range=0..10))
sort_2 = SortList(Keys=partition_2, ValuesA=partition_2)  # -> Keys, ValuesA
python_20 = GhPythonScript(crv=merge_10, params=sort_2.ValuesA)  # -> out, new_crv; inputs crv: list of Curve, params: tree; same code as python_8
offcrv_8 = OffsetCurve(
    Curve=python_20.new_crv,
    Plane=PlaneXY(0, 0, 0),
    Distance=number_slider_16,
    BothSides=0,
    Kinks=0,
    CapType=Slider(0, range=0..100))  # -> flatten(Offset)

addition_8 = Addition(A=number_slider_16, B=fres_line_2.straight_len)
rulesrf_4 = RuledSurface(CurveA=merge_10, CurveB=offcrv_8)
item_26 = ListItem(List=rulesrf_4, Index=0, Wrap=True)
subtraction_12 = Subtraction(A=number_slider_16, B=zub_line_2.straight_len)
wires_8 = BrepWireframe(Brep=rulesrf_4, Density=-1)
neg_10 = Negative(Value=subtraction_12)
offsets_2 = OffsetOnSrf(Curve=item_14.Item1, Distance=zub_line_2.straight_len, Surface=item_26)  # -> flatten(Curve)
offset_5 = OffsetCurve(Curve=offsets_2, Distance=subtraction_12, Corners=1)
divide_3 = DivideCurve(Curve=offsets_2, Count=Slider(2, range=0..10), Kinks=False)  # -> Points, Tangents, Parameters
rulesrf_5 = RuledSurface(CurveA=offsets_2, CurveB=offset_5)
item_27 = ListItem(List=divide_3.Points, Index=0, Wrap=True)  # -> Item, Item1, Item2
arc_2 = Arc3Pt(PointA=item_27.Item, PointB=item_27.Item1, PointC=item_27.Item2)  # -> Arc, Plane, Radius
dim_4 = Dimensions(Surface=rulesrf_5)  # -> UDimension, VDimension
dim_5 = Dimensions(Surface=rulesrf_5)  # -> UDimension, VDimension
panel_14 = Panel(dim_4.VDimension)
pt_32 = ConstructPoint(XCoordinate=pdecon_5.XComponent, YCoordinate=dim_4.VDimension, ZCoordinate=0)
pt_33 = ConstructPoint(XCoordinate=pdecon_6.XComponent, YCoordinate=dim_4.VDimension, ZCoordinate=0)
python_21 = GhPythonScript(x=pt_33, y=pt_32, z=cir_2)  # -> out, a; inputs x: Point3d, y: Point3d; same code as python_9
python_22 = GhPythonScript(x=python_21.a, y=dim_5.UDimension)  # -> out, a; same code as python_10
python_23 = GhPythonScript(x=python_21.a, y=dim_5.UDimension)  # -> out, a; same code as python_11
python_24 = GhPythonScript(x=python_23.a)  # -> out, a; inputs x: list; same code as python_12
join_9 = JoinCurves(Curves=python_24.a, Preserve=False)
group_5 = Group(Objects=join_9)
pshift_2 = ShiftPaths(Data=group_5, Offset=Slider(2, range=0..10))
group_6 = Group(Objects=pshift_2)  # -> flatten(Group)
ungroup_3 = Ungroup(Group=group_6)
pt_34 = ConstructPoint(XCoordinate=pdecon_11.XComponent, YCoordinate=dim_4.VDimension, ZCoordinate=0)
flip_6 = FlipMatrix(Data=ungroup_3)
ungroup_4 = Ungroup(Group=flip_6)
bang_2 = ExplodeTree(Data=wires_8)  # -> Branch0, Branch1, Branch2
cluster_2 = Cluster(G=flip_6)
brec_3 = BoundingRectangle(Geometry=cluster_2, Plane=PlaneXY(0, 0, 0), Axis=0, Slide=0, Union=True)  # -> Bounding, DimensionX, DimensionY
subtraction_13 = Subtraction(A=brec_3.DimensionX, B=dim_4.UDimension)
division_3 = Division(A=subtraction_13, B=Slider(2, range=0..10))
extendsrf_2 = ExtendSurface(Surface=rulesrf_5, WestEdge=division_3, SouthEdge=0, EastEdge=division_3, NorthEdge=0, ExtensionType=True)
ext_4 = ExtendCurve(Curve=offsets_2, Type=0, Start=division_3, End=division_3)
offset_6 = OffsetCurve(Curve=ext_4, Distance=subtraction_12, Corners=1)
cpoly_3 = ControlPolygon(Curve=brec_3.Bounding)  # -> Polygon, Points
trim_2 = TrimTree(Tree=ungroup_4, Depth=1)
pt_35 = ConstructPoint(XCoordinate=pdecon_12.XComponent, YCoordinate=dim_4.VDimension, ZCoordinate=0)
srf_4 = Surface(rulesrf_5)
item_28 = ListItem(List=cpoly_3.Points, Index=0, Wrap=True)
join_10 = JoinCurves(Curves=trim_2, Preserve=False)
X_4 = UnitX(Factor=brec_3.DimensionX)
python_25 = GhPythonScript(x=pt_35, y=pt_34, z=cir_4)  # -> out, a; inputs x: Point3d, y: Point3d; same code as python_13
line_3 = LineSDL(Start=item_28, Direction=X_4, Length=brec_3.DimensionX)
merge_26 = Merge(Data1=bang_2.Branch1, Data2=bang_2.Branch2)  # -> flatten(Result)
python_26 = GhPythonScript(x=python_25.a, y=dim_5.UDimension)  # -> out, a, b; same code as python_14
python_27 = GhPythonScript(crv=merge_26, inters_crv=wires_6)  # -> out, new_crv; inputs crv: list of Curve, inters_crv: list of Curve; same code as python_15
crv_6 = Curve(bang_2.Branch0)
item_29 = ListItem(List=merge_26, Index=Slider(29, range=0..100), Wrap=True)
join_11 = JoinCurves(Curves=crv_6, Preserve=False)
merge_27 = Merge(Data1=python_27.new_crv, Data2=item_29)
python_28 = GhPythonScript(x=python_25.a, y=dim_5.UDimension)  # -> out, a, b; same code as python_16
panel_15 = Panel(merge_27)
item_30 = ListItem(List=bang_2.Branch0, Index=Slider(2, range=0..10), Wrap=True)
srf_5 = Surface(rulesrf_5)
python_29 = GhPythonScript(x=python_28.b)  # -> out, a, b; same code as python_17
join_12 = JoinCurves(Curves=python_29.b, Preserve=False)
brec_4 = BoundingRectangle(Geometry=join_12, Plane=PlaneXY(0, 0, 0), Axis=0, Slide=0, Union=True)  # -> Bounding, DimensionX, DimensionY
cpoly_4 = ControlPolygon(Curve=brec_4.Bounding)  # -> Polygon, Points
item_31 = ListItem(List=cpoly_4.Points, Index=0, Wrap=True)
srf_6 = Surface(brec_4.Bounding)
rulesrf_6 = RuledSurface(CurveA=ext_4, CurveB=offset_6)
map_srf_3 = MapToSurface(Curve=simplify(join_12), Source=reparameterize(simplify(srf_6)), Target=reparameterize(simplify(rulesrf_6)))
ccx_5 = CurveCurve(CurveA=join_11, CurveB=map_srf_3)  # -> Points, ParamsA, ParamsB
alongcrv_2 = SortAlongCurve(Points=ccx_5.Points, Curve=arc_2.Arc)  # -> Points, Indices
X_5 = UnitX(Factor=brec_4.DimensionX)
dim_6 = Dimensions(Surface=rulesrf_6)  # -> UDimension, VDimension
crv_7 = Curve(python_29.a)
panel_16 = Panel(crv_6)
line_4 = LineSDL(Start=item_31, Direction=X_5, Length=brec_4.DimensionX)
item_32 = ListItem(List=alongcrv_2.Points, Index=panel_11, Wrap=True)
map_srf_4 = MapToSurface(Curve=simplify(python_29.a), Source=reparameterize(simplify(srf_6)), Target=reparameterize(simplify(rulesrf_6)))
lng_2 = ListLength(List=map_srf_4)
subtraction_14 = Subtraction(A=lng_2, B=1)
split_2 = SplitList(List=map_srf_4, Index=subtraction_14)  # -> flatten(ListA), ListB
ccx_6 = CurveCurve(CurveA=flatten(join_11), CurveB=split_2.ListA)  # -> Points, ParamsA, ParamsB
tstat_2 = TreeStatistics(Tree=ccx_6.Points)  # -> Paths, Length, Count
python_30 = GhPythonScript(x=tstat_2.Length)  # -> out, a; inputs x: list; same code as python_18
crv_cp_5 = CurveClosestPoint(Point=item_32, Curve=map_srf_3)  # -> Point, Parameter, Distance
crv_cp_6 = CurveClosestPoint(Point=item_32, Curve=join_11)  # -> Point, Parameter, Distance
group_7 = Group(Objects=map_srf_4)  # -> flatten(Group)
shatter_6 = Shatter(Curve=join_11, Parameters=crv_cp_6.Parameter)
crv_8 = Curve(bang_2.Branch0)
shatter_7 = Shatter(Curve=map_srf_3, Parameters=crv_cp_5.Parameter)
item_33 = ListItem(List=shatter_6, Index=Slider(1, range=0..100), Wrap=True)
item_34 = ListItem(List=shatter_7, Index=Slider(1, range=0..10), Wrap=True)
explode_2 = Explode(Curve=item_33, Recursive=True)  # -> Segments, Vertices
python_31 = GhPythonScript(crv=crv_6, inters_crv=merge_10)  # -> out, new_crv; inputs crv: list of Curve, inters_crv: list of Curve; same code as python_19
merge_28 = Merge(Data1=python_31.new_crv)  # -> flatten(Result)
cull_i_2 = CullIndex(List=group_7, Indices=Slider(0, range=0..100), Wrap=True)
join_13 = JoinCurves(Curves=merge_28, Preserve=False)
simplify = SimplifyCurve(Curve=join_13)  # -> Curve, Simplified
fillet = Fillet(Curve=simplify.Simplified, Radius=Slider(0.5, range=0..1))
merge_29 = Merge(Data1=flatten(merge_27), Data2=flatten(join_13), Data3=item_14.Item)
transform_5 = Transform(Geometry=cull_i_2, Transform=orient_2.Transform)
previewlw_9 = CustomPreviewLineweights(
    Geometry=[cull_i_2, merge_27, item_14.Item, fillet],
    Shader=ColourSwatch(SwatchColor=RGB(255, 255, 255)),
    Thickness=Slider(4, range=0..10),
    Absolute=False)
join_14 = JoinCurves(Curves=merge_29, Preserve=False)
transform_6 = Transform(Geometry=join_14, Transform=orient_2.Transform)
previewlw_10 = CustomPreviewLineweights(
    Geometry=[transform_6, transform_5],
    Shader=ColourSwatch(SwatchColor=RGB(255, 255, 255)),
    Thickness=Slider(1, range=0..10),
    Absolute=False)

# ==== cluster Cluster
G = ClusterInput()
ungroup = Ungroup(Group=G)
trim = TrimTree(Tree=ungroup, Depth=1)
center = Center(Geometric=trim)  # -> Center, Dimension
panel = Panel(ungroup)
brec = BoundingRectangle(Geometry=trim, Plane=PlaneXY(0, 0, 0), Axis=0, Slide=0, Union=True)  # -> Bounding, DimensionX, DimensionY
cpoly = ControlPolygon(Curve=brec.Bounding)  # -> Polygon, Points
pdecon = Deconstruct(Point=cpoly.Points)  # -> XComponent, YComponent, ZComponent
pt = ConstructPoint(XCoordinate=pdecon.XComponent, YCoordinate=0, ZCoordinate=pdecon.ZComponent)
merge = Merge(Data1=cpoly.Points, Data2=pt)
R = ClusterOutput(merge)
