# Grasshopper definition 221015_Arc.gh (Grasshopper 1.0.7)
# plug-ins: BubalusGH2.0, Human, Pufferfish, Hops

input = DataInput(
    Destination="/Volumes/GoogleDrive-110500231569640047002/Общие диски/CONTEXTMACHINE/PROJECTS/2202_Lahta_Arc/Lahta Arc_WORK/MM/gh_data/Arc_panels_test.ghdata",
    RelativePath="/Volumes/GoogleDrive-110500231569640047002/Общие диски/CONTEXTMACHINE/PROJECTS/2202_Lahta_Arc/Lahta Arc_WORK/MM/gh_data/Arc_panels_test.ghdata|../../../../../../Volumes/GoogleDrive-110500231569640047002/Общие диски/CONTEXTMACHINE/PROJECTS/2202_Lahta_Arc/Lahta Arc_WORK/MM/gh_data/Arc_panels_test.ghdata",
    UpdateDelay=50000)  # -> Left_Cone_panels_surf_6_row, Left_Cone_panels_surf_6x2_row, Right_Cone_panels_surf_6_row, Right_Cone_panels_surf_6x2_row, Left_Cone_recess_surf, Right_Cone_recess_surf, Hyp_panels_surf_6_row, Hyp_panels_surf_6x2_row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
srf = Surface(flatten(input.Hyp_recess_Vert_02))
srf_2 = Surface(flatten(input.Hyp_recess_Vert_01))
srf_3 = Surface(flatten(input.Hyp_panels_surf_6x2_row))
input_2 = DataInput(
    Destination="/Volumes/GoogleDrive-110500231569640047002/Общие диски/CONTEXTMACHINE/PROJECTS/2202_Lahta_Arc/Lahta Arc_WORK/SF/from_VV/221004_Recess_for_mockup.ghdata",
    RelativePath="/Volumes/GoogleDrive-110500231569640047002/Общие диски/CONTEXTMACHINE/PROJECTS/2202_Lahta_Arc/Lahta Arc_WORK/SF/from_VV/221004_Recess_for_mockup.ghdata|../../../../../../Volumes/GoogleDrive-110500231569640047002/Общие диски/CONTEXTMACHINE/PROJECTS/2202_Lahta_Arc/Lahta Arc_WORK/SF/from_VV/221004_Recess_for_mockup.ghdata",
    UpdateDelay=50000)  # -> Hyp_recess_top, Hyp_recess_Vert_01, Hyp_recess_Vert_02, Hyp_recess_Ribs

# ---- group: RIBS
trim = TrimTree(Tree=input_2.Hyp_recess_Ribs, Depth=1)
tstat = TreeStatistics(Tree=trim)  # -> Paths, Length, Count
panel = Panel("""301
302
303""")
item = ListItem(List=tstat.Paths, Index=panel, Wrap=True)
branch = TreeBranch(Tree=trim, Path=item, MaintainPaths=True)  # -> flatten(Branch)
partition = PartitionList(List=branch, Size=Slider(6, range=0..10))

# ---- group: MICHE
srf_4 = Surface(flatten(input_2.Hyp_recess_Vert_02))
srf_5 = Surface(flatten(input_2.Hyp_recess_Vert_01))
panel_2 = Panel("""301
302
303""")
item_2 = ListItem(List=srf_4, Index=panel_2, Wrap=True)

# ---- group: BACKSIDE
panel_3 = Panel("""301
302
303""")
srf_6 = Surface(flatten(input_2.Hyp_recess_top))
item_3 = ListItem(List=srf_6, Index=panel_3, Wrap=True)

# ----
input_3 = DataInput(
    Destination="/Volumes/GoogleDrive-110500231569640047002/Общие диски/CONTEXTMACHINE/PROJECTS/2202_Lahta_Arc/Lahta Arc_WORK/MP/gh_data/panel_test_2.ghdata",
    RelativePath="/Volumes/GoogleDrive-110500231569640047002/Общие диски/CONTEXTMACHINE/PROJECTS/2202_Lahta_Arc/Lahta Arc_WORK/MP/gh_data/panel_test_2.ghdata|../../../../../../Volumes/GoogleDrive-110500231569640047002/Общие диски/CONTEXTMACHINE/PROJECTS/2202_Lahta_Arc/Lahta Arc_WORK/MP/gh_data/panel_test_2.ghdata",
    UpdateDelay=50000)  # -> Hyp_panels_surf_3, flatten(Hyp_panels_surf_6)
item_4 = ListItem(List=srf_5, Index=panel_2, Wrap=True)
area = Area(Geometry=item_3)  # -> Area, Centroid
srf_cp = SurfaceClosestPoint(Point=area.Centroid, Surface=item_3)  # -> Point, UVPoint, Distance
evalsrf = EvaluateSurface(Surface=item_3, Point=srf_cp.UVPoint)  # -> Point, Normal, UDirection, VDirection, Frame
offsrf = OffsetSurface(Surface=item_3, Distance=Slider(3, range=0..10), BothSides=0, CreateSolid=True)  # -> flatten(Offset)
multiplication = Multiplication(A=evalsrf.Normal, B=3)
move = Move(Geometry=item_3, Motion=multiplication)  # -> Geometry, Transform
file = ReadFile(File="/Users/sofyadobycina/Documents/GitHub/mmodel/panels_gh/main_arc.py", PerLineParse=False)
srf_7 = Surface(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)
srf_8 = Surface(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)
file_2 = ReadFile(File="/Users/sofyadobycina/Documents/GitHub/mmodel/panels_gh/main_niche.py", PerLineParse=False)
file_3 = ReadFile(File="/Users/sofyadobycina/Documents/GitHub/mmodel/panels_gh/main_back.py", PerLineParse=False)
srf_9 = Surface(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)
srf_10 = Surface(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)
srf_11 = Surface(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)
number_slider = Slider(3, range=0..10)
neg = Negative(Value=Slider(3, range=0..10))
swatch = ColourSwatch(SwatchColor=RGB(176, 176, 176))
swatch_2 = ColourSwatch(SwatchColor=RGB(128, 128, 128))
extendcrvonsrf = ExtendCrvOnSrf(Curve=<missing>, Surface=graft(<missing>))

# ---- group: OTGIB
number_slider_2 = Slider(35.2, range=0..100)
panel_4 = Panel("http://192.168.3.10:5000/POST")
toggle = BooleanToggle(True)
panel_5 = Panel("object/create")

# ----
python = GhPythonScript(
    angle_niche=Slider(45, range=0..100),
    side_niche=Slider(0.3, range=0..1),
    met_left_niche=Slider(0.5, range=0..1),
    init_side=number_slider_2)  # -> out, a
# ---------- python: Python ----------
__author__ = "sofyadobycina"

import rhinoscriptsyntax as rs
import math

def angle_ofs(angle, side, met_left):
    ang = math.radians(90/2)
    rad = ((side / 2) / math.cos(ang)) + met_left
    return rad / math.tan(math.radians(angle/2))


def right_angle_ofs(side, met_left):
    ang = math.radians(90 / 2)
    rad = ((side / 2) / math.cos(ang)) + met_left
    return rad

def niche_offset(angle, side, met_left):
    d = angle_ofs(angle, side, met_left) - right_angle_ofs(side, met_left)
    return d * math.tan(math.radians(angle))

def niche_shorten(angle, side, met_left):
    d = angle_ofs(angle, side, met_left) - right_angle_ofs(side, met_left)
    return d / math.cos(math.radians(angle))


side_offset = niche_offset(angle_niche, side_niche, met_left_niche) + (angle_ofs(angle_niche, side_niche, met_left_niche)-right_angle_ofs(side_niche, met_left_niche)) - 0.5
a = init_side - side_offset
print(a)
# ---------- end python ----------

# ---- group: OTGIB
python_2 = GhPythonScript(
    dtype="BendSegmentFres",
    angle=Slider(90, range=1..179),
    radius=Slider(0.712, range=0..10),
    length=Slider(35.2, range=0..100),
    in_rad=Slider(0.2, range=0..1),
    metal_width=Slider(3, range=0..10))  # -> out, a
# ---------- python_2: Python ----------
__author__ = "andrewastakhov"

import rhinoscriptsyntax as rs
import json
from ghpythonlib.treehelpers import list_to_tree, tree_to_list
import Grasshopper
access=Grasshopper.Kernel.GH_ParamAccess
class ApiClass:
    def __init__(self, **kwargs):
        self.__dict__.update(self.__class__.__component_dict__)
        self.__dict__.update(kwargs)
      
    def to_dict(self):
        return self.__dict__
    def __str__(self):
        return "{}(\n\t{}\n)".format(self.dtype, json.dumps(self.__dict__, indent=3)[1:-1])
    def ToString(self):
        return self.__str__()

class ApiType(type):
    def __new__(mcs, name, bases=(), attrs={}):
        attrs['__component_dict__']=dict()

        for prm in ghenv.Component.Params.Input:
            print(prm.Name)
            d=globals()[prm.Name]
            if prm.Access == access.item:
                attrs['__component_dict__'][prm.Name]=d
            elif prm.Access == access(Grasshopper.Kernel.GH_ParamAccess.list):
                attrs['__component_dict__'][prm.Name]=list(d)
            else:
                attrs['__component_dict__'][prm.Name]=tree_to_list(d)

        attrs.update(ApiClass.__dict__)
        attrs['dtype'] = name
        return type(name, bases, attrs)



objs= ApiType(dtype)()



a=objs
# ---------- end python_2 ----------
toggle_2 = BooleanToggle(True)
panel_6 = Panel("object/create")
bendschema = GhPythonScript(x=python_2.a)  # -> a; inputs x: list
# ---------- bendschema: Python ----------
__author__ = "andrewastakhov"

import rhinoscriptsyntax as rs
import json


class Bend(list):
    def __init__(self, seq):
        super(Bend, self).__init__(seq)
        self.seq=seq
    def to_json(self):
        l=[]
        for s in self.seq:
            l.append(s.to_dict())
        return json.dumps({"segments":l}, indent=3)
    def to_simple(self):
        l=[]
        for s in self.seq:
            l.append([s.angle,s.radius, s.length])
        return json.dumps({"segments":l}, indent=3)

a = Bend(x).to_json()
b = Bend(x).to_simple()
# ---------- end bendschema ----------

# ----
hops = Hops(
    _Path="http://192.168.3.10:5000/POST",
    Run=toggle_2,
    Name=panel_6,
    Data=bendschema,
    CacheResultsInMemory=False,
    CacheSolveResults=False,
    RemoteDefinitionLocation="http://192.168.3.10:5000/POST",
    RemoteSolveVersion=(0, 1, 0),
    ShowInput_Enabled=False,
    ShowInput_Path=True,
    SynchronousSolve=True)

# ---- group: OTGIB (continued)
python_3 = GhPythonScript(mmodel_object=hops)  # -> out, inner, outer
# ---------- python_3: Python ----------
__author__ = "andrewastakhov"

import rhinoscriptsyntax as rs
import json
from ghpythonlib.treehelpers import list_to_tree, tree_to_list
from compas.geometry import Line, Point, NurbsCurve, Curve, Polyline
from compas_rhino.geometry import RhinoNurbsCurve
from compas_ghpython.artists import CurveArtist

import Grasshopper
access=Grasshopper.Kernel.GH_ParamAccess
class ApiClass:
    def __init__(self, **kwargs):
        self.__dict__.update(self.__class__.__component_dict__)
        self.__dict__.update(kwargs)
      
    def to_dict(self):
        return self.__dict__
    def __str__(self):
        return "{}(\n\t{}\n)".format(self.dtype, json.dumps(self.__dict__, indent=3)[1:-1])
    def ToString(self):
        return self.__str__()

class ApiType(type):
    def __new__(mcs, name, bases=(), attrs={}):
        attrs['__component_dict__']=dict()

        for prm in ghenv.Component.Params.Input:
            d=globals()[prm.Name]
            if prm.Access == access.item:
                attrs['__component_dict__'][prm.Name]=d
            elif prm.Access == access(Grasshopper.Kernel.GH_ParamAccess.list):
                attrs['__component_dict__'][prm.Name]=list(d)
            else:
                attrs['__component_dict__'][prm.Name]=tree_to_list(d)

        attrs.update(ApiClass.__dict__)
        attrs['dtype'] = name
        return type(name, bases, attrs)

import json
import Rhino.Geometry as rg
data=json.loads(mmodel_object)
metadata=ApiType("metadata")(**data["metadata"])
class Obj(rg.GeometryBase):
    def __init__(self):
        super(rg.GeometryBase).__init__(self)
print rg.GeometryBase.ConstructConstObject.__doc__
obj=[]
for i, d in enumerate(data["data"]["rhino"]):
    obj.append(rg.GeometryBase.FromJSON(json.dumps(d)))
    
inner = []
outer = []
for i, d in enumerate(data["data"]["compas"]):
    v = RhinoNurbsCurve.from_data(d)
    b = CurveArtist(v)
    if i < len(data["data"]["compas"])/2:
        inner.append(b.draw())
    else:
        outer.append(b.draw())

print(inner)
# ---------- end python_3 ----------
crv = Curve(python_3.inner)
crv_2 = Curve(python_3.outer)
join = JoinCurves(Curves=crv_2, Preserve=False)
join_2 = JoinCurves(Curves=crv, Preserve=False)
end = EndPoints(Curve=join_2)  # -> Start, End
end_2 = EndPoints(Curve=join)  # -> Start, End
vec2pt = Vector2Pt(PointA=end_2.Start, PointB=end.Start, Unitize=False)  # -> Vector, Length
move_2 = Move(Geometry=join, Motion=vec2pt.Vector)  # -> Geometry, Transform
move_3 = Move(Geometry=join_2, Motion=vec2pt.Vector)  # -> Geometry, Transform
end_3 = EndPoints(Curve=move_2.Geometry)  # -> Start, End
end_4 = EndPoints(Curve=move_3.Geometry)  # -> Start, End
ln = Line(StartPoint=end_4.Start, EndPoint=end_3.Start)
ln_2 = Line(StartPoint=end_4.End, EndPoint=end_3.End)
merge = Merge(Data1=move_3.Geometry, Data2=ln, Data3=move_2.Geometry, Data4=ln_2)
boundary = BoundarySurfaces(Edges=merge)

# ----
python_4 = GhPythonScript(Code=file_3, Panels=flatten(move.Geometry), Otgib_side=boundary)  # -> Out, Otgib, Surf
brep = Brep(python_4.Otgib)
srf_12 = Surface(python_4.Surf)
offsrf_2 = OffsetSurface(Surface=srf_12, Distance=Slider(3, range=0..10), BothSides=0, CreateSolid=True)
previewlw = CustomPreviewLineweights(Geometry=brep, Shader=ColourSwatch(SwatchColor=RGB(0, 255, 204)), Absolute=False)
previewlw_2 = CustomPreviewLineweights(Geometry=offsrf_2, Shader=ColourSwatch(SwatchColor=RGB(128, 128, 128)), Absolute=False)

# ---- group: OTGIB
python_5 = GhPythonScript(
    dtype="BendSegmentFres",
    angle=Slider(45, range=1..179),
    radius=Slider(0.712, range=0..10),
    length=Slider(35.2, range=0..100),
    in_rad=Slider(0.2, range=0..1),
    metal_width=Slider(3, range=0..10))  # -> out, a; same code as python_2
panel_7 = Panel("http://192.168.3.10:5000/POST")
toggle_3 = BooleanToggle(True)
panel_8 = Panel("object/create")
bendschema_2 = GhPythonScript(x=python_5.a)  # -> a; inputs x: list; same code as bendschema

# ----
hops_2 = Hops(
    _Path=panel_7,
    Run=toggle_3,
    Name=panel_8,
    Data=bendschema_2,
    CacheResultsInMemory=False,
    CacheSolveResults=False,
    RemoteDefinitionLocation="http://192.168.3.10:5000/POST",
    RemoteSolveVersion=(0, 1, 0),
    ShowInput_Enabled=False,
    ShowInput_Path=True,
    SynchronousSolve=True)

# ---- group: OTGIB (continued)
python_6 = GhPythonScript(mmodel_object=hops_2)  # -> out, inner, outer; same code as python_3
crv_3 = Curve(python_6.inner)
crv_4 = Curve(python_6.outer)
join_3 = JoinCurves(Curves=crv_4, Preserve=False)
join_4 = JoinCurves(Curves=crv_3, Preserve=False)
end_5 = EndPoints(Curve=join_4)  # -> Start, End
end_6 = EndPoints(Curve=join_3)  # -> Start, End
vec2pt_2 = Vector2Pt(PointA=end_6.Start, PointB=end_5.Start, Unitize=False)  # -> Vector, Length
move_4 = Move(Geometry=join_3, Motion=vec2pt_2.Vector)  # -> Geometry, Transform
move_5 = Move(Geometry=join_4, Motion=vec2pt_2.Vector)  # -> Geometry, Transform
end_7 = EndPoints(Curve=move_4.Geometry)  # -> Start, End
end_8 = EndPoints(Curve=move_5.Geometry)  # -> Start, End
ln_3 = Line(StartPoint=end_8.Start, EndPoint=end_7.Start)
ln_4 = Line(StartPoint=end_8.End, EndPoint=end_7.End)
merge_2 = Merge(Data1=move_5.Geometry, Data2=ln_3, Data3=move_4.Geometry, Data4=ln_4)
boundary_2 = BoundarySurfaces(Edges=merge_2)

# ----
python_7 = GhPythonScript(Code=file, Panels=flatten(input_3.Hyp_panels_surf_6), Otgib_side=boundary, Otgib_niche=boundary_2)  # -> Out, A, O_left, S_left, O_right, S_right
brep_2 = Brep(python_7.O_left)
srf_13 = Surface(python_7.S_left)
srf_14 = Surface(python_7.S_right)
brep_3 = Brep(python_7.O_right)
previewlw_3 = CustomPreviewLineweights(Geometry=brep_3, Shader=ColourSwatch(SwatchColor=RGB(0, 93, 255)), Absolute=False)
previewlw_4 = CustomPreviewLineweights(Geometry=brep_2, Shader=ColourSwatch(SwatchColor=RGB(130, 0, 237)), Absolute=False)
offsrf_3 = OffsetSurface(Surface=srf_14, Distance=number_slider, BothSides=0, CreateSolid=True)  # -> flatten(Offset)
offsrf_4 = OffsetSurface(Surface=srf_13, Distance=number_slider, BothSides=0, CreateSolid=True)
previewlw_5 = CustomPreviewLineweights(Geometry=offsrf_4, Shader=swatch, Absolute=False)
previewlw_6 = CustomPreviewLineweights(Geometry=offsrf_3, Shader=swatch, Absolute=False)

# ---- group: OTGIB (continued)
python_8 = GhPythonScript(
    dtype="BendSegmentFres",
    angle=Slider(45, range=1..179),
    radius=Slider(0.712, range=0..10),
    length=python.a,
    in_rad=Slider(0.2, range=0..1),
    metal_width=Slider(3, range=0..10))  # -> out, a; same code as python_2
bendschema_3 = GhPythonScript(x=python_8.a)  # -> a; inputs x: list; same code as bendschema

# ----
hops_3 = Hops(
    _Path=panel_4,
    Run=toggle,
    Name=panel_5,
    Data=bendschema_3,
    CacheResultsInMemory=False,
    CacheSolveResults=False,
    RemoteDefinitionLocation="http://192.168.3.10:5000/POST",
    RemoteSolveVersion=(0, 1, 0),
    ShowInput_Enabled=False,
    ShowInput_Path=True,
    SynchronousSolve=True)

# ---- group: OTGIB (continued)
python_9 = GhPythonScript(mmodel_object=hops_3)  # -> out, inner, outer; same code as python_3
crv_5 = Curve(python_9.inner)
crv_6 = Curve(python_9.outer)
join_5 = JoinCurves(Curves=crv_6, Preserve=False)
join_6 = JoinCurves(Curves=crv_5, Preserve=False)
end_9 = EndPoints(Curve=join_6)  # -> Start, End
end_10 = EndPoints(Curve=join_5)  # -> Start, End
vec2pt_3 = Vector2Pt(PointA=end_10.Start, PointB=end_9.Start, Unitize=False)  # -> Vector, Length
move_6 = Move(Geometry=join_5, Motion=vec2pt_3.Vector)  # -> Geometry, Transform
move_7 = Move(Geometry=join_6, Motion=vec2pt_3.Vector)  # -> Geometry, Transform
end_11 = EndPoints(Curve=move_6.Geometry)  # -> Start, End
end_12 = EndPoints(Curve=move_7.Geometry)  # -> Start, End
ln_5 = Line(StartPoint=end_12.Start, EndPoint=end_11.Start)
ln_6 = Line(StartPoint=end_12.End, EndPoint=end_11.End)
merge_3 = Merge(Data1=move_7.Geometry, Data2=ln_5, Data3=move_6.Geometry, Data4=ln_6)
boundary_3 = BoundarySurfaces(Edges=merge_3)

# ----
python_10 = GhPythonScript(Code=file_2, Niche_left=item_4, Niche_right=item_2, Otgib_niche=boundary_3, Otgib_side=boundary)  # -> Out, N_side, N_left, S_left, N_right, S_right, B
brep_4 = Brep(python_10.N_left)
brep_5 = Brep(python_10.N_right)
srf_15 = Surface(python_10.S_left)
brep_6 = Brep(python_10.N_side)
srf_16 = Surface(python_10.S_right)
previewlw_7 = CustomPreviewLineweights(Geometry=brep_6, Shader=ColourSwatch(SwatchColor=RGB(255, 115, 0)), Absolute=False)
previewlw_8 = CustomPreviewLineweights(Geometry=brep_4, Shader=ColourSwatch(SwatchColor=RGB(255, 238, 0)), Absolute=False)
previewlw_9 = CustomPreviewLineweights(Geometry=brep_5, Shader=ColourSwatch(SwatchColor=RGB(0, 207, 48)), Absolute=False)
offsrf_5 = OffsetSurface(Surface=srf_16, Distance=neg, BothSides=0, CreateSolid=True)
offsrf_6 = OffsetSurface(Surface=srf_15, Distance=neg, BothSides=0, CreateSolid=True)
previewlw_10 = CustomPreviewLineweights(Geometry=offsrf_6, Shader=swatch_2, Absolute=False)
previewlw_11 = CustomPreviewLineweights(Geometry=offsrf_5, Shader=swatch_2, Absolute=False)
