# Grasshopper definition 221017_unroll_panel+niche(1).ghx (Grasshopper 1.0.7)
# plug-ins: Human, Wombat

# ---- group: COGGEOM
pt = Point(Point(0, 3.166488276, 0))
pdecon = Deconstruct(Point=pt)  # -> XComponent, YComponent, ZComponent
pt_2 = Point(Point(-11.5, 29.0011855, 0))
number_slider = Slider(33.8, range=0..100)
pt_3 = Point(Point(-6.5, 29.0011855, 0))
number_slider_2 = Slider(1.5, range=0..10)
pdecon_2 = Deconstruct(Point=pt_3)  # -> XComponent, YComponent, ZComponent
pdecon_3 = Deconstruct(Point=pt_2)  # -> XComponent, YComponent, ZComponent
addition = Addition(A=number_slider_2, B=Slider(5, range=0..10))
pt_4 = ConstructPoint(XCoordinate=pdecon_2.XComponent, YCoordinate=number_slider, ZCoordinate=0)
pt_5 = ConstructPoint(XCoordinate=pdecon_3.XComponent, YCoordinate=number_slider, ZCoordinate=0)
pt_6 = ConstructPoint(XCoordinate=pdecon.XComponent, YCoordinate=addition, ZCoordinate=0)
cir = Circle(Plane=pt_6, Radius=number_slider_2)

# ----
input = DataInput(
    Destination="/Volumes/GoogleDrive-110500231569640047002/Общие диски/CONTEXTMACHINE/PROJECTS/2202_Lahta_Arc/Lahta Arc_WORK/SF/from_VV/221004_Recess_for_mockup.ghdata",
    RelativePath="/Volumes/GoogleDrive-110500231569640047002/Общие диски/CONTEXTMACHINE/PROJECTS/2202_Lahta_Arc/Lahta Arc_WORK/SF/from_VV/221004_Recess_for_mockup.ghdata|../../../../../../Volumes/GoogleDrive-110500231569640047002/Общие диски/CONTEXTMACHINE/PROJECTS/2202_Lahta_Arc/Lahta Arc_WORK/SF/from_VV/221004_Recess_for_mockup.ghdata",
    UpdateDelay=50000)  # -> Hyp_recess_top, Hyp_recess_Vert_01, Hyp_recess_Vert_02, Hyp_recess_Ribs
input_2 = DataInput(
    Destination="/Volumes/GoogleDrive-110500231569640047002/Общие диски/CONTEXTMACHINE/PROJECTS/2202_Lahta_Arc/Lahta Arc_WORK/MP/gh_data/panel_test_2.ghdata",
    RelativePath="/Volumes/GoogleDrive-110500231569640047002/Общие диски/CONTEXTMACHINE/PROJECTS/2202_Lahta_Arc/Lahta Arc_WORK/MP/gh_data/panel_test_2.ghdata|../../../../../../Volumes/GoogleDrive-110500231569640047002/Общие диски/CONTEXTMACHINE/PROJECTS/2202_Lahta_Arc/Lahta Arc_WORK/MP/gh_data/panel_test_2.ghdata",
    UpdateDelay=50000)  # -> Hyp_panels_surf_3, Hyp_panels_surf_6

# ---- group: RIBS
trim = TrimTree(Tree=input.Hyp_recess_Ribs, Depth=1)
tstat = TreeStatistics(Tree=trim)  # -> Paths, Length, Count
panel = Panel("""301
302
303""")
item = ListItem(List=tstat.Paths, Index=panel, Wrap=True)
branch = TreeBranch(Tree=trim, Path=item, MaintainPaths=True)  # -> flatten(Branch)
partition = PartitionList(List=branch, Size=Slider(6, range=0..10))

# ----
uvdisplay = SurfaceUVDisplay(Surfaces=partition, Size=1)
previewlw = CustomPreviewLineweights(Geometry=partition, Shader=ColourSwatch(SwatchColor=RGBA(0, 201, 154, 209)), Absolute=False)

# ---- group: PANELS
flip = Flip(Surface=input_2.Hyp_panels_surf_6)  # -> Surface, Result
item_2 = ListItem(List=flip.Surface, Index=0, Wrap=True)  # -> Item, Item1
merge = Merge(Data1=item_2.Item, Data2=item_2.Item1)  # -> flatten(Result)
partition_2 = PartitionList(List=merge, Size=Slider(2, range=0..10))

# ----
uvdisplay_2 = SurfaceUVDisplay(Surfaces=partition_2, Size=1)
previewlw_2 = CustomPreviewLineweights(Geometry=partition_2, Shader=ColourSwatch(SwatchColor=RGBA(18, 81, 255, 207)), Absolute=False)

# ---- group: PROVERKA_PANELS
sdivide = DivideSurface(Surface=item_2.Item, UCount=5, VCount=5)  # -> flatten(Points), Normals, Parameters
sdivide_2 = DivideSurface(Surface=item_2.Item1, UCount=5, VCount=5)  # -> flatten(Points), Normals, Parameters
item_3 = ListItem(List=sdivide.Points, Index=Slider(7, range=0..10), Wrap=True)
item_4 = ListItem(List=sdivide_2.Points, Index=Slider(25, range=0..100), Wrap=True)
preview = CustomPreview(
    Geometry=item_3,
    Material={diffuse=RGB(228, 178, 227), emission=RGB(68, 53, 68), shine=0.5, specular=RGB(255, 254, 254), transparency=0})
preview_2 = CustomPreview(
    Geometry=item_4,
    Material={diffuse=RGB(228, 178, 227), emission=RGB(68, 53, 68), shine=0.5, specular=RGB(255, 254, 254), transparency=0})
unroll_brep = UnrollBrep(Brep=item_2.Item, Points=item_3)  # -> flatten(Brep), Curves, Points
unroll_brep_2 = UnrollBrep(Brep=item_2.Item1, Points=item_4)  # -> flatten(Brep), Curves, Points
pt_7 = Point(unroll_brep.Points)
item_5 = ListItem(List=unroll_brep.Brep, Index=0, Wrap=True)
item_6 = ListItem(List=unroll_brep_2.Brep, Index=0, Wrap=True)
pt_8 = Point(unroll_brep_2.Points)

# ---- group: BACKSIDE
panel_2 = Panel("""301
302
303""")
srf = Surface(flatten(input.Hyp_recess_top))
item_7 = ListItem(List=srf, Index=panel_2, Wrap=True)
flip_2 = Flip(Surface=item_7)  # -> Surface, Result

# ----
uvdisplay_3 = SurfaceUVDisplay(Surfaces=flip_2.Surface, Size=1)
previewlw_3 = CustomPreviewLineweights(Geometry=flip_2.Surface, Shader=ColourSwatch(SwatchColor=RGBA(255, 192, 18, 209)), Absolute=False)

sdivide_3 = DivideSurface(Surface=flip_2.Surface, UCount=5, VCount=5)  # -> flatten(Points), Normals, Parameters
item_8 = ListItem(List=sdivide_3.Points, Index=Slider(7, range=0..100), Wrap=True)
preview_3 = CustomPreview(
    Geometry=item_8,
    Material={diffuse=RGB(228, 178, 227), emission=RGB(68, 53, 68), shine=0.5, specular=RGB(255, 254, 254), transparency=0})
panel_3 = Panel("""10-57
10-58
10-59""")
panel_4 = Panel("""True
False
False""")
unroll_brep_3 = UnrollBrep(Brep=flip_2.Surface, Points=item_8)  # -> flatten(Brep), Curves, Points
item_9 = ListItem(List=unroll_brep_3.Brep, Index=0, Wrap=True)
pt_9 = Point(unroll_brep_3.Points)
F = File("/Users/sofyadobycina/Documents/GitHub/mmodel/panels_gh/main_niche_unroll.py")
F_2 = File("/Users/sofyadobycina/Documents/GitHub/mmodel/panels_gh/main.py")
python = GhPythonScript(x=F)  # -> a
# ---------- python: Python ----------
__author__ = "andrewastakhov"

import rhinoscriptsyntax as rs
import os
def opencode(path):
    with open(path,"r") as code:
        return code.read()
try:
    a=opencode(x)
except:
    yy=x.replace("sofyadobycina/Documents/GitHub/","andrewastakhov/")

    a=opencode(yy)
# ---------- end python ----------
python_2 = GhPythonScript(x=F_2)  # -> a; same code as python
python_3 = GhPythonScript(Code=python)  # -> Out, Niche_side, Back_niche, Ribs
python_4 = GhPythonScript(Code=python_2)  # -> Out, Panel
F_3 = File("/Users/sofyadobycina/Documents/GitHub/mmodel/panels_gh/unroll_pack.py")
python_5 = GhPythonScript(x=F_3)  # -> a; same code as python
pt_10 = Point(pt_4)
pt_11 = Point(pt_5)
circle = Circle(cir)
number_slider_3 = Slider(45, range=0..100)
F_4 = File("/Users/sofyadobycina/Documents/GitHub/mmodel/panels_gh/main_frame.py")
python_6 = GhPythonScript(x=F_4)  # -> a; same code as python
python_7 = GhPythonScript()  # -> out, result
# ---------- python_7: Python ----------
__author__ = "sofyadobycina"

import rhinoscriptsyntax as rs
import ghpythonlib.treehelpers as th




result = unroll_dict.GetString()
# ---------- end python_7 ----------
pt_12 = Point(Point(0, 0, 0))
pt_13 = Point(Point(80, 0, 0))
crv = Curve(<curve referenced from the Rhino model>)
crv_2 = Curve(<curve referenced from the Rhino model>)
crv_3 = Curve([<curve referenced from the Rhino model> x113])
group = Group(Objects=crv_3)
arrlinear = LinearArray(Geometry=pt_12, Direction=pt_13, Count=Slider(6, range=0..10))  # -> Geometry, Transform
item_10 = ListItem(List=partition, Index=Slider(0, range=0..10), Wrap=True)
canvas_color = CanvasColor(Toggle=True, BackgroundColor=ColourSwatch(SwatchColor=RGB(188, 192, 196)))
edges = BrepEdges(Brep=partition)  # -> Naked, Interior, NonManifold
len = Length(Curve=edges.Naked)
panel_5 = Panel(len)

# ---- group: MICHE
srf_2 = Surface(flatten(input.Hyp_recess_Vert_02))
srf_3 = Surface(flatten(input.Hyp_recess_Vert_01))
panel_6 = Panel("""301
302
303""")
item_11 = ListItem(List=srf_2, Index=panel_6, Wrap=True)
flip_3 = Flip(Surface=item_11)  # -> Surface, Result
panel_7 = Panel("""0
1""")

# ----
item_12 = ListItem(List=srf_3, Index=panel_6, Wrap=True)
sdivide_4 = DivideSurface(Surface=graft(flip_3.Surface), UCount=5, VCount=5)  # -> flatten(Points), Normals, Parameters

# ---- group: MICHE (continued)
flip_4 = Flip(Surface=item_12)  # -> Surface, Result
weave = Weave(Pattern=panel_7, Stream0=flip_4.Surface, Stream1=flip_3.Surface, NullGaps=False)
partition_3 = PartitionList(List=weave, Size=Slider(2, range=0..10))

# ----
uvdisplay_4 = SurfaceUVDisplay(Surfaces=flip_4.Surface, Size=1)
uvdisplay_5 = SurfaceUVDisplay(Surfaces=flip_3.Surface, Size=1)
previewlw_4 = CustomPreviewLineweights(Geometry=weave, Shader=ColourSwatch(SwatchColor=RGBA(117, 17, 240, 209)), Absolute=False)

sdivide_5 = DivideSurface(Surface=flip_4.Surface, UCount=5, VCount=5)  # -> flatten(Points), Normals, Parameters
item_13 = ListItem(List=sdivide_5.Points, Index=Slider(25, range=0..100), Wrap=True)
item_14 = ListItem(List=sdivide_4.Points, Index=Slider(7, range=0..100), Wrap=True)
preview_4 = CustomPreview(
    Geometry=item_13,
    Material={diffuse=RGB(228, 178, 227), emission=RGB(68, 53, 68), shine=0.5, specular=RGB(255, 254, 254), transparency=0})
preview_5 = CustomPreview(
    Geometry=item_14,
    Material={diffuse=RGB(228, 178, 227), emission=RGB(68, 53, 68), shine=0.5, specular=RGB(255, 254, 254), transparency=0})
unroll_brep_4 = UnrollBrep(Brep=flip_4.Surface, Points=item_13)  # -> flatten(Brep), Curves, Points
unroll_brep_5 = UnrollBrep(Brep=flip_3.Surface, Points=item_14)  # -> flatten(Brep), Curves, Points
python_8 = GhPythonScript(back_side=flip_2.Surface, niche_side=partition_3, ribs=partition, panels=partition_2, cogs=panel_4, tag=panel_3)  # -> out, pack; inputs back_side: list of Surface, niche_side: tree of Brep, ribs: tree of Surface, panels: tree of Brep, cogs: list of Boolean, tag: list
# ---------- python_8: Python ----------
__author__ = "sofyadobycina"

import rhinoscriptsyntax as rs
import ghpythonlib.treehelpers as th


panels = th.tree_to_list(panels, lambda x: x[0])
ribs = th.tree_to_list(ribs, lambda x: x[0])
niche_side = th.tree_to_list(niche_side, lambda x: x[0])

a=[]
pack = []
for p, n, r, b, c, t in zip(panels, niche_side, ribs, back_side, cogs, tag):
    #r = th.list_to_tree(r)
    pack.append([p[0], p[1], n[0], n[1], r, b, c, t])
    a.append(r)

a = th.list_to_tree(a)

print(pack)
# ---------- end python_8 ----------
item_15 = ListItem(List=unroll_brep_4.Brep, Index=0, Wrap=True)
pt_14 = Point(unroll_brep_4.Points)
item_16 = ListItem(List=partition_3, Index=0, Wrap=True)
item_17 = ListItem(List=unroll_brep_5.Brep, Index=0, Wrap=True)
pt_15 = Point(unroll_brep_5.Points)
item_18 = ListItem(List=python_8.pack, Index=Slider(2, range=0..10), Wrap=True)
python_9 = GhPythonScript(
    Code=python_5,
    Panel=python_4.Panel,
    Niche_side=python_3.Niche_side,
    Back_niche=python_3.Back_niche,
    Ribs=python_3.Ribs,
    Unroll_elems=item_18,
    X=pt_10,
    Y=pt_11,
    Circle=circle)  # -> Out, Pack_unrolls, Packs, A, B, C
item_19 = ListItem(List=python_9.Packs, Index=Slider(0, range=0..1), Wrap=True)
python_10 = GhPythonScript(
    Code=python_6,
    Panel=item_19,
    B_niche=Slider(10, range=0..100),
    N_niche=Slider(43.53, range=0..100),
    P_niche=number_slider_3,
    Bottom=number_slider_3,
    Top=Slider(35, range=0..100))  # -> Out, A, Frame, B
crv_4 = Curve(python_10.B)
panel_8 = Panel(python_10.A)
bang = ExplodeTree(Data=python_10.Frame)  # -> Branch0, Branch1, Branch2, Branch3, Branch4, Branch5, Branch6, Branch7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
move = Move(Geometry=crv_4, Motion=arrlinear.Geometry)  # -> Geometry, Transform
group_2 = Group(Objects=[bang.Branch4, bang.Branch5, bang.Branch6])  # -> flatten(Group)
group_3 = Group(Objects=[bang.Branch2, bang.Branch3])  # -> flatten(Group)
group_4 = Group(Objects=[bang.Branch11, bang.Branch10, bang.Branch12])  # -> flatten(Group)
group_5 = Group(Objects=[bang.Branch7, bang.Branch8, bang.Branch9])  # -> flatten(Group)
group_6 = Group(Objects=[bang.Branch1, bang.Branch0])  # -> flatten(Group)
item_20 = ListItem(List=move.Geometry, Index=Slider(0, range=0..10), Wrap=True)
item_21 = ListItem(List=group_4, Index=0, Wrap=True)  # -> Item, Item1, Item2
previewlw_5 = CustomPreviewLineweights(Geometry=item_21.Item, Shader=ColourSwatch(SwatchColor=RGB(255, 255, 255)), Thickness=2, Absolute=False)
previewlw_6 = CustomPreviewLineweights(Geometry=item_21.Item1, Shader=ColourSwatch(SwatchColor=RGB(255, 0, 0)), Thickness=2, Absolute=False)
previewlw_7 = CustomPreviewLineweights(Geometry=item_21.Item2, Shader=ColourSwatch(SwatchColor=RGB(77, 255, 0)), Thickness=2, Absolute=False)
