# Grasshopper definition 221017_unroll_panel+niche(1).ghx.gh (Grasshopper 1.0.7)
# plug-ins: Human, Wombat

input = DataInput(
    Destination="/Volumes/GoogleDrive/Shared drives/CONTEXTMACHINE/PROJECTS/2202_Lahta_Arc/Lahta Arc_WORK/MM/gh_data/Arc_panels_test.ghdata",
    RelativePath="/Volumes/GoogleDrive/Shared drives/CONTEXTMACHINE/PROJECTS/2202_Lahta_Arc/Lahta Arc_WORK/MM/gh_data/Arc_panels_test.ghdata|../../../../Volumes/GoogleDrive/Shared drives/CONTEXTMACHINE/PROJECTS/2202_Lahta_Arc/Lahta Arc_WORK/MM/gh_data/Arc_panels_test.ghdata",
    UpdateDelay=50000)  # -> Left_Cone_panels_surf_6_row, Left_Cone_panels_surf_6x2_row, Right_Cone_panels_surf_6_row, Right_Cone_panels_surf_6x2_row, Left_Cone_recess_surf, Right_Cone_recess_surf, Hyp_panels_surf_6_row, Hyp_panels_surf_6x2_row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
input_2 = DataInput(
    Destination="/Volumes/GoogleDrive/Shared drives/CONTEXTMACHINE/PROJECTS/2202_Lahta_Arc/Lahta Arc_WORK/MP/gh_data/panel_test_2.ghdata",
    RelativePath="/Volumes/GoogleDrive/Shared drives/CONTEXTMACHINE/PROJECTS/2202_Lahta_Arc/Lahta Arc_WORK/MP/gh_data/panel_test_2.ghdata|../../../../Volumes/GoogleDrive/Shared drives/CONTEXTMACHINE/PROJECTS/2202_Lahta_Arc/Lahta Arc_WORK/MP/gh_data/panel_test_2.ghdata",
    UpdateDelay=50000)  # -> Hyp_panels_surf_3, Hyp_panels_surf_6
input_3 = DataInput(
    Destination="/Volumes/GoogleDrive-110500231569640047002/Общие диски/CONTEXTMACHINE/PROJECTS/2202_Lahta_Arc/Lahta Arc_WORK/MM/gh_data/Arc_panels_test.ghdata",
    RelativePath="/Volumes/GoogleDrive-110500231569640047002/Общие диски/CONTEXTMACHINE/PROJECTS/2202_Lahta_Arc/Lahta Arc_WORK/MM/gh_data/Arc_panels_test.ghdata|../../../../Volumes/GoogleDrive-110500231569640047002/Общие диски/CONTEXTMACHINE/PROJECTS/2202_Lahta_Arc/Lahta Arc_WORK/MM/gh_data/Arc_panels_test.ghdata",
    UpdateDelay=50000)  # -> Left_Cone_panels_surf_6_row, Left_Cone_panels_surf_6x2_row, Right_Cone_panels_surf_6_row, Right_Cone_panels_surf_6x2_row, Left_Cone_recess_surf, Right_Cone_recess_surf, Hyp_panels_surf_6_row, Hyp_panels_surf_6x2_row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
input_4 = DataInput(
    Destination="/Volumes/GoogleDrive-110500231569640047002/Общие диски/CONTEXTMACHINE/PROJECTS/2202_Lahta_Arc/Lahta Arc_WORK/MP/gh_data/panel_test_2.ghdata",
    RelativePath="/Volumes/GoogleDrive-110500231569640047002/Общие диски/CONTEXTMACHINE/PROJECTS/2202_Lahta_Arc/Lahta Arc_WORK/MP/gh_data/panel_test_2.ghdata|../../../../Volumes/GoogleDrive-110500231569640047002/Общие диски/CONTEXTMACHINE/PROJECTS/2202_Lahta_Arc/Lahta Arc_WORK/MP/gh_data/panel_test_2.ghdata",
    UpdateDelay=50000)  # -> Hyp_panels_surf_3, Hyp_panels_surf_6
srf = Surface(flatten(input.Hyp_recess_Vert_02))
srf_2 = Surface(input_2.Hyp_panels_surf_6)
srf_3 = Surface(flatten(input.Hyp_panels_surf_6x2_row))
item = ListItem(List=srf, Index=0, Wrap=True)
flip = Flip(Surface=srf_2)  # -> Surface, Result
flip_2 = Flip(Surface=item)  # -> Surface, Result
item_2 = ListItem(List=srf_3, Index=Slider(1, range=0..10), Wrap=True)
file = ReadFile(File="/Users/andrewastakhov/mmodel/panels_gh/main_niche_unroll.py", PerLineParse=False)
sdivide = DivideSurface(Surface=item, UCount=10, VCount=10)  # -> flatten(Points), Normals, Parameters
item_3 = ListItem(List=flip.Surface, Index=0, Wrap=True)  # -> flatten(Item), flatten(Item1)
python = GhPythonScript(Code=file, Panels=item)  # -> Out, Edges, Cut, Fres
uvdisplay = SurfaceUVDisplay(Surfaces=item, Size=1)
panel = Panel("""0
1
0
1
0
1""")
file_2 = ReadFile(File="/Users/andrewastakhov/mmodel/panels_gh/main.py", PerLineParse=False)
number_slider = Slider(2, range=0..10)
srf_4 = Surface(flatten(flip.Surface))
item_4 = ListItem(List=sdivide.Points, Index=Slider(23, range=0..100), Wrap=True)
rotate = Rotate(Geometry=item_3.Item1, Angle=degrees(Slider(180, range=0..1000)), Plane=PlaneXY(0, 0, 0))  # -> Geometry, Transform
srf_cp = SurfaceClosestPoint(Point=item_4, Surface=item)  # -> Point, UVPoint, Distance
item_5 = ListItem(List=python.Edges, Index=Slider(0, range=0..10), Wrap=True)
evalsrf = EvaluateSurface(Surface=item, Point=srf_cp.UVPoint)  # -> Point, Normal, UDirection, VDirection, Frame
python_2 = GhPythonScript(Code=file_2, Panels=srf_4, Tip=panel)  # -> Out, Fres, Cut, Panel
unroll_brep = UnrollBrep(Brep=item, Points=evalsrf.Point)  # -> Brep, Curves, Points
previewlw = CustomPreviewLineweights(Geometry=python.Cut, Shader=ColourSwatch(SwatchColor=RGB(255, 254, 254)), Thickness=number_slider, Absolute=False)
previewlw_2 = CustomPreviewLineweights(Geometry=python.Fres, Shader=ColourSwatch(SwatchColor=RGB(255, 0, 0)), Thickness=number_slider, Absolute=False)
number_slider_2 = Slider(0, range=0..10)
panel_2 = Panel(python_2.Panel)
flip_3 = FlipMatrix(Data=python_2.Cut)
flip_4 = FlipMatrix(Data=python_2.Fres)
item_6 = ListItem(List=flip_3, Index=number_slider_2, Wrap=True)
item_7 = ListItem(List=flip_4, Index=number_slider_2, Wrap=True)
item_8 = ListItem(List=python_2.Panel, Index=0, Wrap=True)
previewlw_3 = CustomPreviewLineweights(Geometry=item_7, Shader=ColourSwatch(SwatchColor=RGB(255, 0, 0)), Thickness=Slider(2, range=0..10), Absolute=False)
previewlw_4 = CustomPreviewLineweights(Geometry=item_6, Shader=ColourSwatch(SwatchColor=RGB(178, 255, 0)), Thickness=Slider(2, range=0..10), Absolute=False)
number_slider_3 = Slider(45, range=0..100)
number_slider_4 = Slider(45, range=0..100)
python_3 = GhPythonScript(panel=item_8, niche=number_slider_3, bottom=number_slider_3, top=Slider(35, range=0..100))  # -> out, a, flatten(frame)
# ---------- python_3: Python ----------
__author__ = "sofyadobycina"

import rhinoscriptsyntax as rs
import Rhino.Geometry as rh
import math

def offset(crv, ofs_dist, extend=None):
    c = rh.Curve.Offset(crv, rh.Plane.WorldXY, ofs_dist, 0.01, rh.CurveOffsetCornerStyle.Sharp)[0]
    if extend is not None:
        c = rh.Curve.Extend(c, rh.Interval(extend[0], extend[1]))
    return c
    
def bound_rec(crv):
    join = rh.Curve.JoinCurves(crv)[0]
    bound_rec = rh.PolyCurve.GetBoundingBox(join, rh.Plane.WorldXY)
    return bound_rec
    
def intersect(values):
    res = []
    for i, v in enumerate(values):
        param = []
        for ind, val in enumerate(values):
            if i != ind:
                inters = rs.CurveCurveIntersection(v, val)
                if inters is not None:
                    param.append(inters[0][5])
        param = sorted(param)
        if len(param) != 1 and i!=0:
            trimed = rh.Curve.Trim(v, param[0], param[1])
        elif i==3:
            trimed = rh.Curve.Trim(v, v.Domain[0], param[0])
        elif i==0 and len(param) != 1:
            trimed = rh.Curve.Trim(v, param[1], v.Domain[1])
        else:
            trimed = rh.Curve.Trim(v, param[0], v.Domain[1])
        res.append(trimed)
    return res


class FramePanel:
    niche = 45
    bottom = 45
    top = 35
    diag = 20
    
    bottom_rec = 30
    side_rec = 30
    
    
    @property
    def frame_offset(self):
        self._frame_offset = rh.Curve.JoinCurves(self.all_offset()[0:3])
        return self._frame_offset
    
    @property
    def p_top(self):
        self._p_top= self.all_offset()[3]
        return self._p_top
    
    @property
    def frame_all(self):
        self._frame_all = rh.Curve.JoinCurves(self.all_offset())
        return self._frame_all
    
    @property
    def bound_frame(self):
        rec = bound_rec(self.frame_all)
        min_transl = rh.Point3d(rec.Min[0] - FramePanel.side_rec, rec.Min[1] - FramePanel.bottom_rec, 0)
        self._bound_frame = rh.Rectangle3d(rh.Plane.WorldXY, min_transl, rec.Max)
        return self._bound_frame
        
    def __init__(self, panel):
        self.panel = panel
        self.p_niche = self.panel.fres[1]
        self.p_bottom = self.panel.fres[0]
        
    def all_offset(self):
        niche = offset(self.p_niche, FramePanel.niche, extend=[self.p_niche.Domain[0]+200, self.p_niche.Domain[1]-200])

        if niche is None:
            niche = offset(self.p_niche, FramePanel.niche, extend=[self.p_niche.Domain[0]-200, self.p_niche.Domain[1]+200])

        bottom = offset(self.p_bottom, FramePanel.bottom, extend=[self.p_bottom.Domain[0]-200, self.p_bottom.Domain[1]])
        top_s = self.top_side()
        top = offset(self.top_side(), FramePanel.top, extend=[top_s.Domain[0], top_s.Domain[1]+200])
        diag = offset(self.diag_side(), FramePanel.diag)

        all_offset = [bottom, diag, niche, top]
        
        all_offset = intersect(all_offset)
        return all_offset

        
    def top_side(self):
        bound = bound_rec(self.panel.fres)
        top_side = bound.GetEdges()[2]
        return top_side.ToNurbsCurve()
        
    def diag_side(self):
        st = self.panel.niche.top_part.PointAtEnd
        en = self.panel.side[0].top_part.PointAtStart
        p = self.panel.niche.fres.PointAtEnd
        
        crv = rh.Line.ToNurbsCurve(rh.Line(st, en))
        
        crv_d = crv.PointAtLength(rh.Curve.DivideByCount(crv, 2, False)[0])
        FramePanel.diag = rh.Point3d.DistanceTo(p, crv_d) + 10
        return crv


    
FramePanel.niche = niche
FramePanel.bottom = bottom
FramePanel.top = top
aa = FramePanel(panel)

#a = aa.all_offset()
a = aa.bound_frame
frame = aa.frame_offset
# ---------- end python_3 ----------
python_4 = GhPythonScript(panel=item_8, niche=number_slider_4, bottom=number_slider_4, top=Slider(35, range=0..100))  # -> out, a, flatten(frame); same code as python_3
panel_3 = Panel(python_4.frame)
item_9 = ListItem(List=python_4.frame, Index=0, Wrap=True)  # -> flatten(Item)
item_10 = ListItem(List=python_4.a, Index=0, Wrap=True)  # -> flatten(Item)
previewlw_5 = CustomPreviewLineweights(Geometry=item_10, Shader=ColourSwatch(SwatchColor=RGB(0, 81, 255)), Thickness=Slider(4, range=0..10), Absolute=False)
previewlw_6 = CustomPreviewLineweights(Geometry=item_9, Shader=ColourSwatch(SwatchColor=RGB(0, 191, 255)), Thickness=Slider(3, range=0..10), Absolute=False)
