# Grasshopper definition 221017_unroll_panel+niche.ghx (Grasshopper 1.0.7)
# plug-ins: Human, Wombat

# ---- group: COGGEOM
pt = Point(Point(0, 3.166488276, 0))
pdecon = Deconstruct(Point=pt)  # -> XComponent, YComponent, ZComponent
pt_2 = Point(Point(-11.5, 29.0011855, 0))
number_slider = Slider(33.8, range=0..100)
pt_3 = Point(Point(-6.5, 29.0011855, 0))
number_slider_2 = Slider(1.5, range=0..10)
pdecon_2 = Deconstruct(Point=pt_3)  # -> XComponent, YComponent, ZComponent
pdecon_3 = Deconstruct(Point=pt_2)  # -> XComponent, YComponent, ZComponent
addition = Addition(A=number_slider_2, B=Slider(5, range=0..10))
pt_4 = ConstructPoint(XCoordinate=pdecon_2.XComponent, YCoordinate=number_slider, ZCoordinate=0)
pt_5 = ConstructPoint(XCoordinate=pdecon_3.XComponent, YCoordinate=number_slider, ZCoordinate=0)
pt_6 = ConstructPoint(XCoordinate=pdecon.XComponent, YCoordinate=addition, ZCoordinate=0)
cir = Circle(Plane=pt_6, Radius=number_slider_2)

# ----
input = DataInput(
    Destination="/Volumes/GoogleDrive-110500231569640047002/Общие диски/CONTEXTMACHINE/PROJECTS/2202_Lahta_Arc/Lahta Arc_WORK/SF/from_VV/221004_Recess_for_mockup.ghdata",
    RelativePath="/Volumes/GoogleDrive-110500231569640047002/Общие диски/CONTEXTMACHINE/PROJECTS/2202_Lahta_Arc/Lahta Arc_WORK/SF/from_VV/221004_Recess_for_mockup.ghdata|../../../../../../Volumes/GoogleDrive-110500231569640047002/Общие диски/CONTEXTMACHINE/PROJECTS/2202_Lahta_Arc/Lahta Arc_WORK/SF/from_VV/221004_Recess_for_mockup.ghdata",
    UpdateDelay=50000)  # -> Hyp_recess_top, Hyp_recess_Vert_01, Hyp_recess_Vert_02, Hyp_recess_Ribs
input_2 = DataInput(
    Destination="/Volumes/GoogleDrive-110500231569640047002/Общие диски/CONTEXTMACHINE/PROJECTS/2202_Lahta_Arc/Lahta Arc_WORK/MP/gh_data/panel_test_2.ghdata",
    RelativePath="/Volumes/GoogleDrive-110500231569640047002/Общие диски/CONTEXTMACHINE/PROJECTS/2202_Lahta_Arc/Lahta Arc_WORK/MP/gh_data/panel_test_2.ghdata|../../../../../../Volumes/GoogleDrive-110500231569640047002/Общие диски/CONTEXTMACHINE/PROJECTS/2202_Lahta_Arc/Lahta Arc_WORK/MP/gh_data/panel_test_2.ghdata",
    UpdateDelay=50000)  # -> Hyp_panels_surf_3, Hyp_panels_surf_6

# ---- group: RIBS
trim = TrimTree(Tree=input.Hyp_recess_Ribs, Depth=1)
tstat = TreeStatistics(Tree=trim)  # -> Paths, Length, Count
panel = Panel("""301
302
303""")
item = ListItem(List=tstat.Paths, Index=panel, Wrap=True)
branch = TreeBranch(Tree=trim, Path=item, MaintainPaths=True)  # -> flatten(Branch)
partition = PartitionList(List=branch, Size=Slider(6, range=0..10))

# ----
uvdisplay = SurfaceUVDisplay(Surfaces=partition, Size=1)
previewlw = CustomPreviewLineweights(Geometry=partition, Shader=ColourSwatch(SwatchColor=RGBA(0, 201, 154, 209)), Absolute=False)

# ---- group: PANELS
flip = Flip(Surface=input_2.Hyp_panels_surf_6)  # -> Surface, Result
item_2 = ListItem(List=flip.Surface, Index=0, Wrap=True)  # -> Item, Item1
merge = Merge(Data1=item_2.Item, Data2=item_2.Item1)  # -> flatten(Result)
partition_2 = PartitionList(List=merge, Size=Slider(2, range=0..10))

# ----
uvdisplay_2 = SurfaceUVDisplay(Surfaces=partition_2, Size=1)
previewlw_2 = CustomPreviewLineweights(Geometry=partition_2, Shader=ColourSwatch(SwatchColor=RGBA(18, 81, 255, 207)), Absolute=False)

# ---- group: PROVERKA_PANELS
sdivide = DivideSurface(Surface=item_2.Item, UCount=5, VCount=5)  # -> flatten(Points), Normals, Parameters
sdivide_2 = DivideSurface(Surface=item_2.Item1, UCount=5, VCount=5)  # -> flatten(Points), Normals, Parameters
item_3 = ListItem(List=sdivide.Points, Index=Slider(7, range=0..10), Wrap=True)
item_4 = ListItem(List=sdivide_2.Points, Index=Slider(25, range=0..100), Wrap=True)
preview = CustomPreview(
    Geometry=item_3,
    Material={diffuse=RGB(228, 178, 227), emission=RGB(68, 53, 68), shine=0.5, specular=RGB(255, 254, 254), transparency=0})
preview_2 = CustomPreview(
    Geometry=item_4,
    Material={diffuse=RGB(228, 178, 227), emission=RGB(68, 53, 68), shine=0.5, specular=RGB(255, 254, 254), transparency=0})
unroll_brep = UnrollBrep(Brep=item_2.Item, Points=item_3)  # -> flatten(Brep), Curves, Points
unroll_brep_2 = UnrollBrep(Brep=item_2.Item1, Points=item_4)  # -> flatten(Brep), Curves, Points
pt_7 = Point(unroll_brep.Points)
item_5 = ListItem(List=unroll_brep.Brep, Index=0, Wrap=True)
item_6 = ListItem(List=unroll_brep_2.Brep, Index=0, Wrap=True)
pt_8 = Point(unroll_brep_2.Points)

# ---- group: BACKSIDE
panel_2 = Panel("""301
302
303""")
srf = Surface(flatten(input.Hyp_recess_top))
item_7 = ListItem(List=srf, Index=panel_2, Wrap=True)
flip_2 = Flip(Surface=item_7)  # -> Surface, Result

# ----
uvdisplay_3 = SurfaceUVDisplay(Surfaces=flip_2.Surface, Size=1)
previewlw_3 = CustomPreviewLineweights(Geometry=flip_2.Surface, Shader=ColourSwatch(SwatchColor=RGBA(255, 192, 18, 209)), Absolute=False)

sdivide_3 = DivideSurface(Surface=flip_2.Surface, UCount=5, VCount=5)  # -> flatten(Points), Normals, Parameters
item_8 = ListItem(List=sdivide_3.Points, Index=Slider(7, range=0..100), Wrap=True)
preview_3 = CustomPreview(
    Geometry=item_8,
    Material={diffuse=RGB(228, 178, 227), emission=RGB(68, 53, 68), shine=0.5, specular=RGB(255, 254, 254), transparency=0})
panel_3 = Panel("""True
False
False""")
panel_4 = Panel("""10-57
10-58
10-59""")
unroll_brep_3 = UnrollBrep(Brep=flip_2.Surface, Points=item_8)  # -> flatten(Brep), Curves, Points
item_9 = ListItem(List=unroll_brep_3.Brep, Index=0, Wrap=True)
pt_9 = Point(unroll_brep_3.Points)
F = File("/Users/sofyadobycina/Documents/GitHub/mmodel/panels_gh/main_niche_unroll.py")
F_2 = File("/Users/sofyadobycina/Documents/GitHub/mmodel/panels_gh/main.py")
python = GhPythonScript(x=F)  # -> a
# ---------- python: Python ----------
__author__ = "andrewastakhov"

import rhinoscriptsyntax as rs
import os
def opencode(path):
    with open(path,"r") as code:
        return code.read()
try:
    a=opencode(x)
except:
    yy=x.replace("sofyadobycina/Documents/GitHub/","andrewastakhov/")

    a=opencode(yy)
# ---------- end python ----------
python_2 = GhPythonScript(x=F_2)  # -> a; same code as python
python_3 = GhPythonScript(Code=python)  # -> Out, Niche_side, Back_niche, Ribs
python_4 = GhPythonScript(Code=python_2)  # -> Out, Panel
F_3 = File("/Users/sofyadobycina/Documents/GitHub/mmodel/panels_gh/unroll_pack.py")
python_5 = GhPythonScript(x=F_3)  # -> a; same code as python
pt_10 = Point(pt_4)
pt_11 = Point(pt_5)
circle = Circle(cir)
number_slider_3 = Slider(45, range=0..100)
F_4 = File("/Users/sofyadobycina/Documents/GitHub/mmodel/panels_gh/main_frame.py")
python_6 = GhPythonScript(x=F_4)  # -> a; same code as python
python_7 = GhPythonScript()  # -> out, a, frame
# ---------- python_7: Python ----------
__author__ = "sofyadobycina"

import rhinoscriptsyntax as rs
import Rhino.Geometry as rh
import math
import ghpythonlib.treehelpers as th

def offset(crv, ofs_dist, extend=None):
    c = rh.Curve.Offset(crv, rh.Plane.WorldXY, ofs_dist, 0.01, rh.CurveOffsetCornerStyle.Sharp)[0]
    if extend is not None:
        c = rh.Curve.Extend(c, rh.Interval(extend[0], extend[1]))
    return c
    
def bound_rec(crv):
    join = rh.Curve.JoinCurves(crv)[0]
    bound_rec = rh.PolyCurve.GetBoundingBox(join, rh.Plane.WorldXY)
    return bound_rec
    
def intersect(values):
    res = []
    for i, v in enumerate(values):
        param = []
        for ind, val in enumerate(values):
            if i != ind:
                inters = rs.CurveCurveIntersection(v, val)
                if inters is not None:
                    param.append(inters[0][5])
        param = sorted(param)
        if len(param) != 1 and i!=0:
            trimed = rh.Curve.Trim(v, param[0], param[1])
        elif i==3:
            trimed = rh.Curve.Trim(v, v.Domain[0], param[0])
        elif i==0 and len(param) != 1:
            trimed = rh.Curve.Trim(v, param[1], v.Domain[1])
        else:
            trimed = rh.Curve.Trim(v, param[0], v.Domain[1])
        res.append(trimed)
    return res


class FramePanel:
    niche = 45
    bottom = 45
    top = 35
    diag = 20
    
    bottom_rec = 30
    side_rec = 30
    
    rect = rh.Rectangle3d(rh.Plane.WorldXY, rh.Point3d(-2.5,-2,0), rh.Point3d(2.5,12,0)).ToNurbsCurve()
    
    
    @property
    def frame_offset(self):
        fr_one = self.frame_inner()[0]
        p_o = self.bound_frame.ClosestPoint(fr_one.PointAtStart)[1]
        p_t = self.bound_frame.ClosestPoint(fr_one.PointAtEnd)[1]
        inters = self.bound_frame.Trim(p_o, p_t)
        self._frame_offset = rh.Curve.JoinCurves([inters,fr_one])[0]
        return self._frame_offset
    
    @property
    def frame_all(self):
        self._frame_all = rh.Curve.JoinCurves(self.all_offset())
        return self._frame_all
    
    @property
    def bound_frame(self):
        rec = bound_rec(self.frame_all)
        min_transl = rh.Point3d(rec.Min[0] - FramePanel.side_rec, rec.Min[1] - FramePanel.bottom_rec, 0)
        bound_frame = rh.Rectangle3d(rh.Plane.WorldXY, min_transl, rec.Max)
        self._bound_frame=bound_frame .ToNurbsCurve()
        return self._bound_frame
    
    @property
    def rec(self):
        rec = bound_rec(self.frame_all)
        return rec
    
    @property
    def region(self):
        new_crv = None
        if self.cogs is True:
            elems = self.cogs_points(2) + self.simple_points(0)
        else:
            elems = self.simple_points(2, niche=1) + self.simple_points(0)
        elems.append(self.frame_offset)
        elems.append(self.panel.cut[0])
        new = list(rh.Curve.CreateBooleanUnion(elems, 0.1))
        new.extend(self.panel.cut[1:])
        return new
        
    
    @property
    def all_elems(self):
        
        a = [self.region, self.panel.fres]
        
        try:
            g = []
            for i in self.panel.grav[:-1][0]:
                for j in i:
                    g.append(j)
            g.append(self.panel.grav[-1])
            a.append(g)
            
        except AttributeError:
            pass
            
        return a
        
        
    def __init__(self, panel, type, nich_ofs):
        FramePanel.niche = nich_ofs
        self.panel = panel
        self.cogs = self.panel.cogs_bend
        self.type = type
        
        
        self.p_niche = self.panel.fres[1]
        
        if self.type == 1:
            self.p_bottom = self.panel.fres[2]
        else:
            self.p_bottom = self.panel.fres[0]
        
        self.panel.unroll_dict['frame']['bb'] = bound_rec(self.frame_all)
            
    def tr_rect(self, p, ind, spec=None):
            crv = self.all_offset()[ind]
            frame = crv.FrameAt(crv.ClosestPoint(p)[1])[1]
            if frame.YAxis[0] < 0 and spec is None:
                frame = rh.Plane(frame.Origin, frame.XAxis, -frame.YAxis)
            else:
                frame = rh.Plane(frame.Origin, frame.XAxis, frame.YAxis)
            tr = rh.Transform.PlaneToPlane(rh.Plane.WorldXY, frame)
            rect = self.rect.DuplicateCurve()
            rect.Transform(tr)
            return rect
        
    def cogs_points(self, side):
        
        rectang =[]
        for i in self.panel.cut[2:-1:8]:
            b = i.TryGetCircle(0.1)[1].Center
            rect = self.tr_rect(b, side)
            rectang.append(rect)
            
        b = self.panel.cut[-1].TryGetCircle(0.1)[1].Center
        rect = self.tr_rect(b, side)
        rectang.append(rect)
        return rectang
    
    
    def simple_points(self, side, niche=None):
        rectang =[]
        if niche is not None:
            crv = self.panel.top_parts[1]
        elif self.type == 0:
            crv = self.panel.top_parts[0]
        else:
            crv = self.panel.top_parts[2]
        
        st = crv.ClosestPoint(crv.PointAtLength(7.5))[1]
        end = crv.ClosestPoint(crv.PointAtLength(crv.GetLength()-7.5))[1]
        n_crv = crv.Trim(st, end)
        
        num = math.ceil(n_crv.GetLength()/100)
        param = n_crv.DivideByCount(num, True)
        points = [n_crv.PointAt(i) for i in param]
        if self.type == 1 and niche is None:
            rectang = [self.tr_rect(i, side, spec=True) for i in points]
        else:
            rectang = [self.tr_rect(i, side) for i in points]
        return rectang
        
        
        
    def all_offset(self):
        niche = offset(self.p_niche, FramePanel.niche, extend=[self.p_niche.Domain[0]+200, self.p_niche.Domain[1]-200])

        if niche is None:
            niche = offset(self.p_niche, FramePanel.niche, extend=[self.p_niche.Domain[0]-200, self.p_niche.Domain[1]+200])

        bottom = offset(self.p_bottom, FramePanel.bottom, extend=[self.p_bottom.Domain[0]-200, self.p_bottom.Domain[1]])
        top_s = self.top_side()
        top = offset(self.top_side(), FramePanel.top, extend=[top_s.Domain[0], top_s.Domain[1]+200])
        diag = offset(self.diag_side(), FramePanel.diag)

        all_offset = [bottom, diag, niche, top]
        
        all_offset = intersect(all_offset)
        return all_offset

        
    def top_side(self):
        bound = bound_rec(self.panel.fres)
        top_side = bound.GetEdges()[2]
        return top_side.ToNurbsCurve()
        
    def diag_side(self):
        if self.type == 0:
            st = self.panel.top_parts[1].PointAtEnd
            en = self.panel.top_parts[0].PointAtStart
            p = self.p_niche.PointAtEnd
        else:
            st = self.panel.top_parts[1].PointAtEnd
            en = self.panel.top_parts[2].PointAtStart
            p = self.p_niche.PointAtEnd
        
        crv = rh.Line.ToNurbsCurve(rh.Line(st, en))
        
        crv_d = crv.PointAtLength(rh.Curve.DivideByCount(crv, 2, False)[0])
        FramePanel.diag = rh.Point3d.DistanceTo(p, crv_d) + 10
        return crv
        
    def frame_inner(self):
        offset = rh.Curve.JoinCurves(self.all_offset()[0:3])[0]
        crv = rh.Line(offset.PointAtEnd, rh.Point3d(offset.PointAtEnd[0], offset.PointAtEnd[1] - self.bottom + 15, offset.PointAtEnd[2])).ToNurbsCurve()
        frame_offset = rh.Curve.JoinCurves([offset,crv])
        return frame_offset
        


class MarkerDict:
    def __init__(self, input_dict):
        self.__dict__.update(input_dict)

    def GetString(self):
        return self.__dict__.__str__()





FramePanel.bottom = bottom
FramePanel.top = top

panel_r = FramePanel(panel.panel_r, p_niche)
panel_l = FramePanel(panel.panel_l, p_niche)

niche_r = FramePanel(panel.niche_r, n_niche)
niche_l = FramePanel(panel.niche_l, n_niche)

niche_b = FramePanel(panel.niche_b, p_niche)

a = MarkerDict(panel.unroll_dict)

frame = [niche_r.all_elems, niche_l.all_elems, panel_r.all_elems, panel_l.all_elems, niche_b.all_elems]
frame = th.list_to_tree(frame)
# ---------- end python_7 ----------
canvas_color = CanvasColor(Toggle=True, BackgroundColor=ColourSwatch(SwatchColor=RGB(188, 192, 196)))

# ---- group: MICHE
srf_2 = Surface(flatten(input.Hyp_recess_Vert_02))
srf_3 = Surface(flatten(input.Hyp_recess_Vert_01))
panel_5 = Panel("""301
302
303""")
item_10 = ListItem(List=srf_2, Index=panel_5, Wrap=True)
flip_3 = Flip(Surface=item_10)  # -> Surface, Result
panel_6 = Panel("""0
1""")

# ----
item_11 = ListItem(List=srf_3, Index=panel_5, Wrap=True)
sdivide_4 = DivideSurface(Surface=graft(flip_3.Surface), UCount=5, VCount=5)  # -> flatten(Points), Normals, Parameters

# ---- group: MICHE (continued)
flip_4 = Flip(Surface=item_11)  # -> Surface, Result
weave = Weave(Pattern=panel_6, Stream0=flip_4.Surface, Stream1=flip_3.Surface, NullGaps=False)
partition_3 = PartitionList(List=weave, Size=Slider(2, range=0..10))

# ----
uvdisplay_4 = SurfaceUVDisplay(Surfaces=flip_4.Surface, Size=1)
uvdisplay_5 = SurfaceUVDisplay(Surfaces=flip_3.Surface, Size=1)
previewlw_4 = CustomPreviewLineweights(Geometry=weave, Shader=ColourSwatch(SwatchColor=RGBA(117, 17, 240, 209)), Absolute=False)

sdivide_5 = DivideSurface(Surface=flip_4.Surface, UCount=5, VCount=5)  # -> flatten(Points), Normals, Parameters
item_12 = ListItem(List=sdivide_5.Points, Index=Slider(25, range=0..100), Wrap=True)
item_13 = ListItem(List=sdivide_4.Points, Index=Slider(7, range=0..100), Wrap=True)
preview_4 = CustomPreview(
    Geometry=item_12,
    Material={diffuse=RGB(228, 178, 227), emission=RGB(68, 53, 68), shine=0.5, specular=RGB(255, 254, 254), transparency=0})
preview_5 = CustomPreview(
    Geometry=item_13,
    Material={diffuse=RGB(228, 178, 227), emission=RGB(68, 53, 68), shine=0.5, specular=RGB(255, 254, 254), transparency=0})
unroll_brep_4 = UnrollBrep(Brep=flip_4.Surface, Points=item_12)  # -> flatten(Brep), Curves, Points
unroll_brep_5 = UnrollBrep(Brep=flip_3.Surface, Points=item_13)  # -> flatten(Brep), Curves, Points
python_8 = GhPythonScript(back_side=flip_2.Surface, niche_side=partition_3, ribs=partition, panels=partition_2, cogs=panel_3, tag=panel_4)  # -> out, pack; inputs back_side: list of Surface, niche_side: tree of Brep, ribs: tree of Surface, panels: tree of Brep, cogs: list of Boolean, tag: list
# ---------- python_8: Python ----------
__author__ = "sofyadobycina"

import rhinoscriptsyntax as rs
import ghpythonlib.treehelpers as th


panels = th.tree_to_list(panels, lambda x: x[0])
ribs = th.tree_to_list(ribs, lambda x: x[0])
niche_side = th.tree_to_list(niche_side, lambda x: x[0])


pack = []
for p, n, r, b, c, t in zip(panels, niche_side, ribs, back_side, cogs, tag):
    #r = th.list_to_tree(r)
    pack.append([p[0], p[1], n[0], n[1], r, b, c, t])

#pack = th.list_to_tree(pack)

print(pack)
# ---------- end python_8 ----------
item_14 = ListItem(List=unroll_brep_4.Brep, Index=0, Wrap=True)
pt_12 = Point(unroll_brep_4.Points)
item_15 = ListItem(List=unroll_brep_5.Brep, Index=0, Wrap=True)
pt_13 = Point(unroll_brep_5.Points)
item_16 = ListItem(List=python_8.pack, Index=Slider(1, range=0..10), Wrap=True)
python_9 = GhPythonScript(
    Code=python_5,
    Panel=python_4.Panel,
    Niche_side=python_3.Niche_side,
    Back_niche=python_3.Back_niche,
    Ribs=python_3.Ribs,
    Unroll_elems=item_16,
    X=pt_10,
    Y=pt_11,
    Circle=circle)  # -> Out, Pack_unrolls, Packs, A, B, C
crv = Curve(python_9.A)
item_17 = ListItem(List=python_9.Packs, Index=Slider(0, range=0..1), Wrap=True)
previewlw_5 = CustomPreviewLineweights(Geometry=python_9.A, Shader=ColourSwatch(SwatchColor=RGB(255, 255, 255)), Thickness=2, Absolute=False)
previewlw_6 = CustomPreviewLineweights(Geometry=python_9.B, Shader=ColourSwatch(SwatchColor=RGB(255, 0, 0)), Thickness=2, Absolute=False)
python_10 = GhPythonScript(
    Code=python_6,
    Panel=item_17,
    B_niche=Slider(10, range=0..100),
    N_niche=Slider(43.53, range=0..100),
    P_niche=number_slider_3,
    Bottom=number_slider_3,
    Top=Slider(35, range=0..100))  # -> Out, A, Frame, B
python_11 = GhPythonScript(unroll_dict=python_10.A)  # -> out, result
# ---------- python_11: Python ----------
__author__ = "sofyadobycina"

import rhinoscriptsyntax as rs
import ghpythonlib.treehelpers as th




result = unroll_dict.GetString()
# ---------- end python_11 ----------
bang = ExplodeTree(Data=python_10.Frame)  # -> Branch0, Branch1, Branch2, Branch3, Branch4, Branch5, Branch6, Branch7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
group = Group(Objects=[bang.Branch6, bang.Branch7])  # -> flatten(Group)
group_2 = Group(Objects=[bang.Branch3, bang.Branch4, bang.Branch5])  # -> flatten(Group)
group_3 = Group(Objects=[bang.Branch10, bang.Branch11])  # -> flatten(Group)
group_4 = Group(Objects=[bang.Branch9, bang.Branch8])  # -> flatten(Group)
group_5 = Group(Objects=[bang.Branch1, bang.Branch0, bang.Branch2])  # -> flatten(Group)
item_18 = ListItem(List=group_2, Index=0, Wrap=True)  # -> Item, Item1, Item2
previewlw_7 = CustomPreviewLineweights(Geometry=item_18.Item, Shader=ColourSwatch(SwatchColor=RGB(255, 255, 255)), Thickness=2, Absolute=False)
previewlw_8 = CustomPreviewLineweights(Geometry=item_18.Item1, Shader=ColourSwatch(SwatchColor=RGB(255, 0, 0)), Thickness=2, Absolute=False)
previewlw_9 = CustomPreviewLineweights(Geometry=item_18.Item2, Shader=ColourSwatch(SwatchColor=RGB(77, 255, 0)), Thickness=2, Absolute=False)
