# Grasshopper definition 221101_sizes_giparpanels.ghx (Grasshopper 1.0.7)

# ---- group: COGGEOM
pt = Point(Point(0, 3.166488276, 0))
pdecon = Deconstruct(Point=pt)  # -> XComponent, YComponent, ZComponent
pt_2 = Point(Point(-11.5, 29.0011855, 0))
number_slider = Slider(33.8, range=0..100)
pt_3 = Point(Point(-6.5, 29.0011855, 0))
number_slider_2 = Slider(1.5, range=0..10)
pdecon_2 = Deconstruct(Point=pt_3)  # -> XComponent, YComponent, ZComponent
pdecon_3 = Deconstruct(Point=pt_2)  # -> XComponent, YComponent, ZComponent
addition = Addition(A=number_slider_2, B=Slider(5, range=0..10))
pt_4 = ConstructPoint(XCoordinate=pdecon_2.XComponent, YCoordinate=number_slider, ZCoordinate=0)
pt_5 = ConstructPoint(XCoordinate=pdecon_3.XComponent, YCoordinate=number_slider, ZCoordinate=0)
pt_6 = ConstructPoint(XCoordinate=pdecon.XComponent, YCoordinate=addition, ZCoordinate=0)
cir = Circle(Plane=pt_6, Radius=number_slider_2)

# ----
input = DataInput(
    Destination="/Volumes/GoogleDrive-110500231569640047002/Общие диски/CONTEXTMACHINE/PROJECTS/2202_Lahta_Arc/Lahta Arc_WORK/MM/gh_data/Arc_panels_master.ghdata",
    RelativePath="/Volumes/GoogleDrive-110500231569640047002/Общие диски/CONTEXTMACHINE/PROJECTS/2202_Lahta_Arc/Lahta Arc_WORK/MM/gh_data/Arc_panels_master.ghdata|../../../../../../../Volumes/GoogleDrive-110500231569640047002/Общие диски/CONTEXTMACHINE/PROJECTS/2202_Lahta_Arc/Lahta Arc_WORK/MM/gh_data/Arc_panels_master.ghdata",
    UpdateDelay=5)  # -> Left_Cone_panels_surf6_row, Left_Cone_panels_surf6x2_row, Right_Cone_panels_surf6_row, Right_Cone_panels_surf6x2_row, Left_Cone_recess_surf, Right_Cone_recess_surf, Hyp_panels_surf6_row, Hyp_panels_surf6x2_row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
panel = Panel("/Users/sofyadobycina/Documents/GitHub/mmodel/panels_gh/for_stats/frame_optional_elems.py")
panel_2 = Panel("/Users/sofyadobycina/Documents/GitHub/mmodel/panels_gh/main_niche_unroll.py")
srf = Surface(input.Hyp_panels_surf6x2_row)
number_slider_3 = Slider(45, range=0..100)
flip = Flip(Surface=srf)  # -> Surface, Result
txt = Text("/Users/sofyadobycina/Documents/GitHub/mmodel/panels_gh/main.py")
python = GhPythonScript(x=panel)  # -> a
# ---------- python: Python ----------
__author__ = "andrewastakhov"

import rhinoscriptsyntax as rs
import os



def opencode(path):
    with open(path,"r") as code:
        return code.read()
try:
    a=opencode(x)
except:
    
    yy=x.replace("/Users/sofyadobycina/Documents/GitHub/mmodel", os.getenv("MMODEL_DIR"))
    
    a=opencode(yy)
# ---------- end python ----------
split = SplitList(List=flatten(flip.Surface), Index=Slider(14, range=0..100))  # -> ListA, ListB
python_2 = GhPythonScript(x=panel_2)  # -> a; same code as python
python_3 = GhPythonScript(x=txt)  # -> a; same code as python
partition = PartitionList(List=split.ListA, Size=Slider(2, range=0..10))
python_4 = GhPythonScript(Code=python_2)  # -> Out, Niche_side, Back_niche, Ribs
python_5 = GhPythonScript(
    Code=python,
    B_niche=Slider(10, range=0..100),
    N_niche=Slider(43.53, range=0..100),
    P_niche=number_slider_3,
    Bottom=number_slider_3,
    Top=Slider(35, range=0..100))  # -> Out, Frame
python_6 = GhPythonScript(Code=python_3)  # -> Out, Panel
python_7 = GhPythonScript(panels=partition)  # -> out, pack; inputs panels: tree of Brep
# ---------- python_7: Python ----------
__author__ = "sofyadobycina"

import rhinoscriptsyntax as rs
import ghpythonlib.treehelpers as th


panels = th.tree_to_list(panels, lambda x: x[0][0])



pack_ = {'P-0':[], 'P-1':[]}
for p in panels:
    pack_['P-0'].append(p[0])
    pack_['P-1'].append(p[1])


class MarkerDict:
    def __init__(self, input_dict):
        self.__dict__.update(input_dict)

    def GetString(self):
        return self.__dict__.__str__()
        
pack = MarkerDict(pack_)
print(pack.__dict__)
# ---------- end python_7 ----------
panel_3 = Panel("/Users/sofyadobycina/Documents/GitHub/mmodel/panels_gh/for_stats/unroll_optional_elems.py")
pt_7 = Point(pt_4)
pt_8 = Point(pt_5)
circle = Circle(cir)
python_8 = GhPythonScript(x=panel_3)  # -> a; same code as python
python_9 = GhPythonScript(
    Code=python_8,
    Frame=python_5.Frame,
    Panel=python_6.Panel,
    Niche_side=python_4.Niche_side,
    Back_niche=python_4.Back_niche,
    Ribs=python_4.Ribs,
    Unroll_elems=python_7.pack,
    X=pt_7,
    Y=pt_8,
    Circle=circle)  # -> Out, Geom, Packs, Bound
trim = TrimTree(Tree=python_9.Geom, Depth=1)
number_slider_4 = Slider(25, range=0..100)
tstat = TreeStatistics(Tree=trim)  # -> Paths, Length, Count
item = ListItem(List=python_9.Bound, Index=number_slider_4, Wrap=True)
item_2 = ListItem(List=tstat.Paths, Index=number_slider_4, Wrap=True)
branch = TreeBranch(Tree=trim, Path=item_2, MaintainPaths=True)
panel_4 = Panel(trim)
crv = Curve(branch)
