# Grasshopper definition strong .ghx.gh (Grasshopper 1.0.7)
# plug-ins: BubalusGH2.0, Hops, Human

input = DataInput(
    Destination="/Volumes/GoogleDrive-110500231569640047002/Общие диски/CONTEXTMACHINE/PROJECTS/2202_Lahta_Arc/Lahta Arc_WORK/MM/gh_data/Arc_panels_master.ghdata",
    RelativePath="/Volumes/GoogleDrive-110500231569640047002/Общие диски/CONTEXTMACHINE/PROJECTS/2202_Lahta_Arc/Lahta Arc_WORK/MM/gh_data/Arc_panels_master.ghdata|../../../../../../Volumes/GoogleDrive-110500231569640047002/Общие диски/CONTEXTMACHINE/PROJECTS/2202_Lahta_Arc/Lahta Arc_WORK/MM/gh_data/Arc_panels_master.ghdata",
    UpdateDelay=50000)  # -> Left_Cone_panels_surf_6_row, Left_Cone_panels_surf_6x2_row, Right_Cone_panels_surf_6_row, Right_Cone_panels_surf_6x2_row, Left_Cone_recess_surf, Right_Cone_recess_surf, Hyp_panels_surf_6_row, Hyp_panels_surf_6x2_row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
srf = Surface(flatten(input.Hyp_recess_Vert_01))
srf_2 = Surface(flatten(input.Hyp_recess_Vert_02))
item = ListItem(List=input.Hyp_panels_surf_6x2_row, Index=0, Wrap=True)  # -> Item, Item1
file = ReadFile(File="/Users/sofyadobycina/Documents/GitHub/mmodel/panels_gh/main_arc.py", PerLineParse=False)
file_2 = ReadFile(File="/Users/sofyadobycina/Documents/GitHub/mmodel/panels_gh/main_niche.py", PerLineParse=False)
extendcrvonsrf = ExtendCrvOnSrf(Curve=<missing>, Surface=graft(<missing>))

# ---- group: OTGIB
python = GhPythonScript(
    dtype="BendSegmentFres",
    angle=Slider(90, range=1..179),
    radius=Slider(0.712, range=0..10),
    length=Slider(37, range=0..100),
    in_rad=Slider(0.2, range=0..1),
    metal_width=Slider(3, range=0..10))  # -> out, a
# ---------- python: Python ----------
__author__ = "andrewastakhov"

import rhinoscriptsyntax as rs
import json
from ghpythonlib.treehelpers import list_to_tree, tree_to_list
import Grasshopper
access=Grasshopper.Kernel.GH_ParamAccess
class ApiClass:
    def __init__(self, **kwargs):
        self.__dict__.update(self.__class__.__component_dict__)
        self.__dict__.update(kwargs)
      
    def to_dict(self):
        return self.__dict__
    def __str__(self):
        return "{}(\n\t{}\n)".format(self.dtype, json.dumps(self.__dict__, indent=3)[1:-1])
    def ToString(self):
        return self.__str__()

class ApiType(type):
    def __new__(mcs, name, bases=(), attrs={}):
        attrs['__component_dict__']=dict()

        for prm in ghenv.Component.Params.Input:
            print(prm.Name)
            d=globals()[prm.Name]
            if prm.Access == access.item:
                attrs['__component_dict__'][prm.Name]=d
            elif prm.Access == access(Grasshopper.Kernel.GH_ParamAccess.list):
                attrs['__component_dict__'][prm.Name]=list(d)
            else:
                attrs['__component_dict__'][prm.Name]=tree_to_list(d)

        attrs.update(ApiClass.__dict__)
        attrs['dtype'] = name
        return type(name, bases, attrs)



objs= ApiType(dtype)()



a=objs
# ---------- end python ----------
panel = Panel("http://192.168.3.10:5050/POST")
toggle = BooleanToggle(True)
panel_2 = Panel("object/create")
bendschema = GhPythonScript(x=python.a)  # -> a; inputs x: list
# ---------- bendschema: Python ----------
__author__ = "andrewastakhov"

import rhinoscriptsyntax as rs
import json


class Bend(list):
    def __init__(self, seq):
        super(Bend, self).__init__(seq)
        self.seq=seq
    def to_json(self):
        l=[]
        for s in self.seq:
            l.append(s.to_dict())
        return json.dumps({"segments":l}, indent=3)
    def to_simple(self):
        l=[]
        for s in self.seq:
            l.append([s.angle,s.radius, s.length])
        return json.dumps({"segments":l}, indent=3)

a = Bend(x).to_json()
b = Bend(x).to_simple()
# ---------- end bendschema ----------

# ----
hops = Hops(
    _Path=panel,
    Run=toggle,
    Name=panel_2,
    Data=bendschema,
    CacheResultsInMemory=False,
    CacheSolveResults=False,
    RemoteDefinitionLocation="http://192.168.3.10:5050/POST",
    RemoteSolveVersion=(0, 1, 0),
    ShowInput_Enabled=False,
    ShowInput_Path=True,
    SynchronousSolve=True)

# ---- group: OTGIB (continued)
python_2 = GhPythonScript(mmodel_object=hops)  # -> out, inner, outer
# ---------- python_2: Python ----------
__author__ = "andrewastakhov"

import rhinoscriptsyntax as rs
import json
from ghpythonlib.treehelpers import list_to_tree, tree_to_list
from compas.geometry import Line, Point, NurbsCurve, Curve, Polyline
from compas_rhino.geometry import RhinoNurbsCurve
from compas_ghpython.artists import CurveArtist

import Grasshopper
access=Grasshopper.Kernel.GH_ParamAccess
class ApiClass:
    def __init__(self, **kwargs):
        self.__dict__.update(self.__class__.__component_dict__)
        self.__dict__.update(kwargs)
      
    def to_dict(self):
        return self.__dict__
    def __str__(self):
        return "{}(\n\t{}\n)".format(self.dtype, json.dumps(self.__dict__, indent=3)[1:-1])
    def ToString(self):
        return self.__str__()

class ApiType(type):
    def __new__(mcs, name, bases=(), attrs={}):
        attrs['__component_dict__']=dict()

        for prm in ghenv.Component.Params.Input:
            d=globals()[prm.Name]
            if prm.Access == access.item:
                attrs['__component_dict__'][prm.Name]=d
            elif prm.Access == access(Grasshopper.Kernel.GH_ParamAccess.list):
                attrs['__component_dict__'][prm.Name]=list(d)
            else:
                attrs['__component_dict__'][prm.Name]=tree_to_list(d)

        attrs.update(ApiClass.__dict__)
        attrs['dtype'] = name
        return type(name, bases, attrs)

import json
import Rhino.Geometry as rg
data=json.loads(mmodel_object)
metadata=ApiType("metadata")(**data["metadata"])
class Obj(rg.GeometryBase):
    def __init__(self):
        super(rg.GeometryBase).__init__(self)
print rg.GeometryBase.ConstructConstObject.__doc__
obj=[]
for i, d in enumerate(data["data"]["rhino"]):
    obj.append(rg.GeometryBase.FromJSON(json.dumps(d)))
    
inner = []
outer = []
for i, d in enumerate(data["data"]["compas"]):
    v = RhinoNurbsCurve.from_data(d)
    b = CurveArtist(v)
    if i < len(data["data"]["compas"])/2:
        inner.append(b.draw())
    else:
        outer.append(b.draw())

print(inner)
# ---------- end python_2 ----------
crv = Curve(python_2.inner)
crv_2 = Curve(python_2.outer)
join = JoinCurves(Curves=crv_2, Preserve=False)
join_2 = JoinCurves(Curves=crv, Preserve=False)
end = EndPoints(Curve=join_2)  # -> Start, End
end_2 = EndPoints(Curve=join)  # -> Start, End
vec2pt = Vector2Pt(PointA=end_2.Start, PointB=end.Start, Unitize=False)  # -> Vector, Length
move = Move(Geometry=join, Motion=vec2pt.Vector)  # -> Geometry, Transform
move_2 = Move(Geometry=join_2, Motion=vec2pt.Vector)  # -> Geometry, Transform
end_3 = EndPoints(Curve=move.Geometry)  # -> Start, End
end_4 = EndPoints(Curve=move_2.Geometry)  # -> Start, End
ln = Line(StartPoint=end_4.Start, EndPoint=end_3.Start)
ln_2 = Line(StartPoint=end_4.End, EndPoint=end_3.End)
merge = Merge(Data1=move_2.Geometry, Data2=ln, Data3=move.Geometry, Data4=ln_2)
boundary = BoundarySurfaces(Edges=merge)

python_3 = GhPythonScript(
    dtype="BendSegmentFres",
    angle=Slider(45, range=1..179),
    radius=Slider(0.712, range=0..10),
    length=Slider(37, range=0..100),
    in_rad=Slider(0.2, range=0..1),
    metal_width=Slider(3, range=0..10))  # -> out, a; same code as python
panel_3 = Panel("http://192.168.3.10:5050/POST")
toggle_2 = BooleanToggle(True)
panel_4 = Panel("object/create")
bendschema_2 = GhPythonScript(x=python_3.a)  # -> a; inputs x: list; same code as bendschema

# ----
hops_2 = Hops(
    _Path=panel_3,
    Run=toggle_2,
    Name=panel_4,
    Data=bendschema_2,
    CacheResultsInMemory=False,
    CacheSolveResults=False,
    RemoteDefinitionLocation="http://192.168.3.10:5050/POST",
    RemoteSolveVersion=(0, 1, 0),
    ShowInput_Enabled=False,
    ShowInput_Path=True,
    SynchronousSolve=True)
hops_3 = Hops(
    _Path=panel_3,
    Run=toggle_2,
    Name=panel_4,
    Data=bendschema_2,
    CacheResultsInMemory=False,
    CacheSolveResults=False,
    RemoteDefinitionLocation="http://192.168.3.10:5050/POST",
    RemoteSolveVersion=(0, 1, 0),
    ShowInput_Enabled=False,
    ShowInput_Path=True,
    SynchronousSolve=True)

# ---- group: OTGIB (continued)
python_4 = GhPythonScript(mmodel_object=hops_3)  # -> out, inner, outer; same code as python_2
crv_3 = Curve(python_4.inner)
crv_4 = Curve(python_4.outer)
join_3 = JoinCurves(Curves=crv_4, Preserve=False)
join_4 = JoinCurves(Curves=crv_3, Preserve=False)
end_5 = EndPoints(Curve=join_4)  # -> Start, End
end_6 = EndPoints(Curve=join_3)  # -> Start, End
vec2pt_2 = Vector2Pt(PointA=end_6.Start, PointB=end_5.Start, Unitize=False)  # -> Vector, Length
move_3 = Move(Geometry=join_3, Motion=vec2pt_2.Vector)  # -> Geometry, Transform
move_4 = Move(Geometry=join_4, Motion=vec2pt_2.Vector)  # -> Geometry, Transform
end_7 = EndPoints(Curve=move_3.Geometry)  # -> Start, End
end_8 = EndPoints(Curve=move_4.Geometry)  # -> Start, End
ln_3 = Line(StartPoint=end_8.Start, EndPoint=end_7.Start)
ln_4 = Line(StartPoint=end_8.End, EndPoint=end_7.End)
merge_2 = Merge(Data1=move_4.Geometry, Data2=ln_3, Data3=move_3.Geometry, Data4=ln_4)
boundary_2 = BoundarySurfaces(Edges=merge_2)

# ----
python_5 = GhPythonScript(Code=file, Panels=flatten(input.Hyp_panels_surf_6x2_row), Otgib_side=boundary, Otgib_niche=boundary_2)  # -> Out, A, O_left, S_left, O_right, S_right
python_6 = GhPythonScript(Code=file_2, Niche_left=srf, Niche_right=srf_2, Otgib_niche=boundary_2)  # -> Out, A, N_left, S_left, N_right, S_right
brep = Brep(python_5.O_left)
brep_2 = Brep(python_5.O_right)
srf_3 = Surface(python_5.S_right)
srf_4 = Surface(python_5.S_left)
brep_3 = Brep(python_6.N_left)
srf_5 = Surface(python_6.S_left)
brep_4 = Brep(python_6.N_right)
srf_6 = Surface(python_6.S_right)
previewmat = CustomPreviewMaterials(Geometry=brep, DiffuseColor=ColourSwatch(SwatchColor=RGB(130, 0, 237)))
previewmat_2 = CustomPreviewMaterials(Geometry=brep_2, DiffuseColor=ColourSwatch(SwatchColor=RGB(0, 93, 255)))
previewmat_3 = CustomPreviewMaterials(Geometry=brep_4, DiffuseColor=ColourSwatch(SwatchColor=RGB(0, 207, 48)))
previewmat_4 = CustomPreviewMaterials(Geometry=brep_3, DiffuseColor=ColourSwatch(SwatchColor=RGB(255, 238, 0)))
previewmat_5 = CustomPreviewMaterials(Geometry=srf_3, DiffuseColor=ColourSwatch(SwatchColor=RGB(176, 176, 176)))
previewmat_6 = CustomPreviewMaterials(Geometry=srf_4, DiffuseColor=ColourSwatch(SwatchColor=RGB(176, 176, 176)))
previewmat_7 = CustomPreviewMaterials(Geometry=srf_5, DiffuseColor=ColourSwatch(SwatchColor=RGB(128, 128, 128)), Transparency=Slider(0.5, range=0..1))
previewmat_8 = CustomPreviewMaterials(Geometry=srf_6, DiffuseColor=ColourSwatch(SwatchColor=RGB(128, 128, 128)), Transparency=Slider(0.5, range=0..1))
